# Dynamo graph Architectural Starter_ALL Project Setup v24_0422_script.dyn "Architectural Starter_ALL Project Setup v24_0422" (Dynamo 2.19.3.6394)
# author: HGA DPG
# Use this script to customize the HGA starter project based on your project needs.
# packages: Data-Shapes 2022.2.103, BumbleBee 2021.25.3, archi-lab.net 2023.213.1523, Clockwork for Dynamo 2.x 2.4.0, designtech 1.0.8, Rhythm 2022.9.1, HGA Usage Tracker 1.0.0, WombatDynamo 2.3.5, Genius Loci 2023.2.21

# group: INPUTS
# note: INPUT
# note: USE:
# FOR USER INPUTS (SLIDERS, STRING INPUTS, BOOLEANS, ETC ...)

# group: UI FORM CREATION
# note: CONTROL
# note: USE:
# FOR CREATING USER INPUT FORMS
#  (DATA-SHAPES)

# group: FILE INPUTS
# note: INPUT
# note: USE:
# FOR THE INCOMMING REFFERENCES
# (FILE PATHS, GEOMETRIES...)

# group: FUNCTIONALITY
# note: USE:
# FOR CORE FUNTIONALITY OF SCRIPT (LIST MANAGEMENT, DATA PARSING, ETC...)
# note: FUNCTIONALITY

# group: FUNCTIONALITY
# note: FUNCTIONALITY
# note: USE:
# FOR CORE FUNTIONALITY OF SCRIPT (LIST MANAGEMENT, DATA PARSING, ETC...)

# group: FUNCTIONALITY
# note: USE:
# FOR CORE FUNTIONALITY OF SCRIPT (LIST MANAGEMENT, DATA PARSING, ETC...)
# note: FUNCTIONALITY

# group: TO REVIT
# note: TO REVIT
# note: USE:
# FOR BLOCKS THAT EXPORT THE GEOMETRY AND PARAMETERS TO REVIT

# group: MONITOR
# note: USE:
# FOR IMPORTANT WATCH NODES
# note: MONITOR

# group: ANNOTATION
# note: ANNOTATION
# note: USE:
# FOR COMMENTS

# group: WIP
# note: USE:
# FOR "WORK IN PROGRESS"
# note: WIP

code_block = CodeBlock { "HGA Production Setup"; }
code_block_2 = CodeBlock()
# ---------- code_block_2.designscript (4 lines) ----------
"Keynote Method
";
"Generic";
"User Keynotes (preferred)";
# ----------------------------------------
UI_TextSplitter = Custom[UI_TextSplitter](str=code_block_2.out0)  # package HGA Usage Tracker; This node will split a single string of text as necessary to input into data shapes so that text doesn't overlap lists, dropdowns, etc.
create = List.Create(item0=code_block_2.out1, item1=code_block_2.out2)
code_block_3 = CodeBlock { 1; }
code_block_4 = CodeBlock { false; }
dropdown_data = Custom[DropDown Data](InputName=UI_TextSplitter, Keys=create, Values=create, DefaultValueIndex=code_block_3, Sorted_optional=code_block_4)  # package Data-Shapes; Create data for DropDown input in UI.MultiInputForm ++ . Check out www.data-shapes.net for more infos.

# group: Basic Prodcution Settings
code_block_5 = CodeBlock()
# ---------- code_block_5.designscript (21 lines) ----------
true;
["Level 02", "Level 03", "Level 04", "Level 05", "Level 06", "Level 07", "Level 08", "Lower Level", "Roof"];
1;
true;
true;
true;
true;
true;
true;
true;
true;
true;
true;
true;
true;
true;
true;
true;
true;
true;
true;
# ----------------------------------------
file_path = Filename("W:\BIM_Resources\Dynamo\!Dynamo Player 2.x\HGA Architectural\Default Detail Lists\_NO DETAILS.xlsx")
code_block_6 = CodeBlock { "All Details"; "B4"; }
file_path_2 = Filename("W:\BIM_Resources\Dynamo\!Dynamo Player 2.x\HGA Architectural\Default Family Lists\ESSENTIALS_ONLY_Families.xlsx")
code_block_7 = CodeBlock { "All Families"; "C4"; true; true; true; true; true; }
list_create = List.Create(item0=code_block_5.out0, item1=code_block_5.out1, item2=code_block_5.out2, item3=code_block_5.out3, item4=code_block_5.out4, item5=code_block_5.out5, item6=code_block_5.out6, item7=code_block_5.out7, item8=code_block_5.out8, item9=code_block_5.out9, item10=code_block_5.out10, item11=code_block_5.out11, item12=code_block_5.out12, item13=code_block_5.out13, item14=code_block_5.out14, item15=code_block_5.out15, item16=code_block_5.out16, item17=code_block_5.out17, item18=code_block_5.out18, item19=code_block_5.out19, item20=code_block_5.out20, item21=file_path, item22=code_block_6.out0, item23=code_block_6.out1, item24=file_path_2, item25=code_block_7.out0, item26=code_block_7.out1, item27=code_block_7.out2, item28=code_block_7.out3, item29=code_block_7.out4, item30=code_block_7.out5, item31=code_block_7.out6)

file_path_3 = Filename("..\Shared Files\HGA_ClassicLogo_Bug_.png")
fromPath = FileObject(path=file_path_3)  # "File.FromPath"
readFromFile = Image.ReadFromFile(file=fromPath)
code_block_8 = CodeBlock { "Run Setup"; }
code_block_9 = CodeBlock()
# ---------- code_block_9.designscript (6 lines) ----------
"Note:";
"
Please scroll down on the right and enter values when applicable. DON'T FORGET you need to specify excel files for the details and families you need for a project.

*** Running this script will create usage data for DPG, Door Hardware and Spec Teams. Based on your settings, a member of these teams may reach out. ***
 ";
# ----------------------------------------
textnote_data = Custom[TextNote Data](Title=code_block_9.out0, TextNote=code_block_9.out1)  # package Data-Shapes; Create Data for TextNote input in UI.MultipleInputForm ++ . Check out www.data-shapes.net for more informations
code_block_10 = CodeBlock { "Is this project confidential?:"; true; "Check box for Yes(or possibly)/Leave unchecked for No"; }
UI_TextSplitter_2 = Custom[UI_TextSplitter](str=code_block_10.out0)
boolean_input = Custom[Boolean input](InputName=UI_TextSplitter_2, DefaultValue=code_block_10.out1, SideText=code_block_10.out2)  # package Data-Shapes; Creates a boolean input for UI.MultipleInputForm ++ . Check out www.data-shapes.net for more infos!
code_block_11 = CodeBlock()
# ---------- code_block_11.designscript (2 lines) ----------
"Check Levels to Remove:";
["Lower Level","Level 01","Level 02","Level 03","Level 04","Level 05", "Level 06", "Level 07", "Level 08", "ROOF"];
# ----------------------------------------
UI_TextSplitter_3 = Custom[UI_TextSplitter](str=code_block_11.out0)
code_block_12 = CodeBlock { 100; }
listview_data = Custom[Listview Data](InputName=UI_TextSplitter_3, Keys=code_block_11.out1, Values=code_block_11.out1, Height_optionnal=code_block_12)  # package Data-Shapes; Create data for ListView input in UI.MultiInputForm ++ . Check out www.data-shapes.net for more infos.
code_block_13 = CodeBlock { "What type of plans do you envision needing?"; }
UI_TextSplitter_4 = Custom[UI_TextSplitter](str=code_block_13)
code_block_14 = CodeBlock()
# ---------- code_block_14.designscript (3 lines) ----------
"Floor Plans without Area / Matchline Plans";
"Overall Plans with Area / Matchline Plans";
"Overall Plans with Dimension / Notations Plans (Healthcare)";
# ----------------------------------------
list_create_2 = List.Create(item0=code_block_14.out0, item1=code_block_14.out1, item2=code_block_14.out2)
code_block_15 = CodeBlock { 1; 2; 3; }
list_create_3 = List.Create(item0=code_block_15.out0, item1=code_block_15.out1, item2=code_block_15.out2)
dropdown_data_2 = Custom[DropDown Data](InputName=UI_TextSplitter_4, Keys=list_create_2, Values=list_create_3)
code_block_16 = CodeBlock()
# ---------- code_block_16.designscript (4 lines) ----------
"Check to Remove:";
false;
"    Sheets A020-A029
    Site Information";
# ----------------------------------------
UI_TextSplitter_5 = Custom[UI_TextSplitter](str=code_block_16.out0)
boolean_input_2 = Custom[Boolean input](InputName=UI_TextSplitter_5, DefaultValue=code_block_16.out1, SideText=code_block_16.out2)
code_block_17 = CodeBlock()
# ---------- code_block_17.designscript (3 lines) ----------
false;
"    Sheets G060-G069
    Phasing Plans";
# ----------------------------------------
boolean_input_3 = Custom[Boolean input](DefaultValue=code_block_17.out0, SideText=code_block_17.out1)
code_block_18 = CodeBlock()
# ---------- code_block_18.designscript (3 lines) ----------
false;
"    Sheets A100-A199
    Demolition Plans";
# ----------------------------------------
boolean_input_4 = Custom[Boolean input](DefaultValue=code_block_18.out0, SideText=code_block_18.out1)
code_block_19 = CodeBlock()
# ---------- code_block_19.designscript (3 lines) ----------
false;
"    Sheets A210-A220
    Slab Edge Plans";
# ----------------------------------------
boolean_input_5 = Custom[Boolean input](DefaultValue=code_block_19.out0, SideText=code_block_19.out1)
code_block_20 = CodeBlock()
# ---------- code_block_20.designscript (4 lines) ----------
false;
"    Sheets A220-A279
    Tele Data / Equipment,
    Furniture and Finish Plans";
# ----------------------------------------
boolean_input_6 = Custom[Boolean input](DefaultValue=code_block_20.out0, SideText=code_block_20.out1)
code_block_21 = CodeBlock()
# ---------- code_block_21.designscript (3 lines) ----------
false;
"    Sheets A400-A499
    Exterior Details";
# ----------------------------------------
boolean_input_7 = Custom[Boolean input](DefaultValue=code_block_21.out0, SideText=code_block_21.out1)
code_block_22 = CodeBlock()
# ---------- code_block_22.designscript (3 lines) ----------
false;
"    Sheets A500-A599
    Vertical Circulation";
# ----------------------------------------
boolean_input_8 = Custom[Boolean input](DefaultValue=code_block_22.out0, SideText=code_block_22.out1)
code_block_23 = CodeBlock()
# ---------- code_block_23.designscript (3 lines) ----------
false;
"    Sheets A600-A601
    Mounting Heights";
# ----------------------------------------
boolean_input_9 = Custom[Boolean input](DefaultValue=code_block_23.out0, SideText=code_block_23.out1)
code_block_24 = CodeBlock()
# ---------- code_block_24.designscript (4 lines) ----------
false;
"    Sheets A610-A649
    Enlarged Plans and
    Interior Elevations";
# ----------------------------------------
boolean_input_10 = Custom[Boolean input](DefaultValue=code_block_24.out0, SideText=code_block_24.out1)
code_block_25 = CodeBlock()
# ---------- code_block_25.designscript (3 lines) ----------
false;
"    Sheets A650-A659
    Restrooms and Showers";
# ----------------------------------------
boolean_input_11 = Custom[Boolean input](DefaultValue=code_block_25.out0, SideText=code_block_25.out1)
code_block_26 = CodeBlock()
# ---------- code_block_26.designscript (4 lines) ----------
false;
"    Sheets A660-A669
    Interior Partition Types
    and Details";
# ----------------------------------------
boolean_input_12 = Custom[Boolean input](DefaultValue=code_block_26.out0, SideText=code_block_26.out1)
code_block_27 = CodeBlock()
# ---------- code_block_27.designscript (3 lines) ----------
false;
"    Sheets A670-A679
    Ceiling Details";
# ----------------------------------------
boolean_input_13 = Custom[Boolean input](DefaultValue=code_block_27.out0, SideText=code_block_27.out1)
code_block_28 = CodeBlock()
# ---------- code_block_28.designscript (3 lines) ----------
false;
"    Sheets A680-A689
    Casework Details";
# ----------------------------------------
boolean_input_14 = Custom[Boolean input](DefaultValue=code_block_28.out0, SideText=code_block_28.out1)
code_block_29 = CodeBlock()
# ---------- code_block_29.designscript (3 lines) ----------
false;
"    Sheets A690-A699
    Finish Details";
# ----------------------------------------
boolean_input_15 = Custom[Boolean input](DefaultValue=code_block_29.out0, SideText=code_block_29.out1)
code_block_30 = CodeBlock()
# ---------- code_block_30.designscript (4 lines) ----------
false;
"    Sheets A700-A729
    Opening Types, Schedules,
   and Details";
# ----------------------------------------
boolean_input_16 = Custom[Boolean input](DefaultValue=code_block_30.out0, SideText=code_block_30.out1)
code_block_31 = CodeBlock()
# ---------- code_block_31.designscript (4 lines) ----------
false;
"    Sheets A730-A739
    Room Finish and Equipment
   Schedules";
# ----------------------------------------
boolean_input_17 = Custom[Boolean input](DefaultValue=code_block_31.out0, SideText=code_block_31.out1)
code_block_32 = CodeBlock()
# ---------- code_block_32.designscript (3 lines) ----------
false;
"    Sheets A800-A899
    Lab Content";
# ----------------------------------------
boolean_input_18 = Custom[Boolean input](DefaultValue=code_block_32.out0, SideText=code_block_32.out1)
code_block_33 = CodeBlock()
# ---------- code_block_33.designscript (5 lines) ----------
true;
"    Sheets A900-A999
    Sheet Specifications

*** SEE NOTE AT BEGINNING ***";
# ----------------------------------------
boolean_input_19 = Custom[Boolean input](DefaultValue=code_block_33.out0, SideText=code_block_33.out1)
code_block_34 = CodeBlock { "Detail Requirements"; }
UI_TextSplitter_6 = Custom[UI_TextSplitter](str=code_block_34)
directory_path = Directory("W:\BIM_Resources\Dynamo\!Dynamo Player\4_Architecture_Template\Default Detail Lists")
code_block_35 = CodeBlock { "Click Here to Select Excel File (REQUIRED)"; }
filepath_data = Custom[FilePath Data](InputName=UI_TextSplitter_6, DefaulPath=directory_path, ButtonText=code_block_35)  # package Data-Shapes; Create filepath input for UI.MultipleInputForm ++ . Check out www.data-shapes.net for more infos !
code_block_36 = CodeBlock { "Sheet Name"; "All Details"; }
UI_TextSplitter_7 = Custom[UI_TextSplitter](str=code_block_36.out0)
textbox_data = Custom[TextBox Data](InputName=UI_TextSplitter_7, DefaultText=code_block_36.out1)  # package Data-Shapes; Create Data for TextBox input in UI.MultipleInputForm ++ . Check out www.data-shapes.net for more informations
code_block_37 = CodeBlock { "Starting Cell"; "B4"; }
UI_TextSplitter_8 = Custom[UI_TextSplitter](str=code_block_37.out0)
textbox_data_2 = Custom[TextBox Data](InputName=UI_TextSplitter_8, DefaultText=code_block_37.out1)
code_block_38 = CodeBlock { "Family Requirements"; }
UI_TextSplitter_9 = Custom[UI_TextSplitter](str=code_block_38)
directory_path_2 = Directory("W:\BIM_Resources\Dynamo\!Dynamo Player\4_Architecture_Template\Default Family Lists")
filepath_data_2 = Custom[FilePath Data](InputName=UI_TextSplitter_9, DefaulPath=directory_path_2, ButtonText=code_block_35)
code_block_39 = CodeBlock { "Sheet Name"; "All Families"; }
UI_TextSplitter_10 = Custom[UI_TextSplitter](str=code_block_39.out0)
textbox_data_3 = Custom[TextBox Data](InputName=UI_TextSplitter_10, DefaultText=code_block_39.out1)
code_block_40 = CodeBlock { "Starting Cell"; "C4"; }
UI_TextSplitter_11 = Custom[UI_TextSplitter](str=code_block_40.out0)
textbox_data_4 = Custom[TextBox Data](InputName=UI_TextSplitter_11, DefaultText=code_block_40.out1)
code_block_41 = CodeBlock()
# ---------- code_block_41.designscript (3 lines) ----------
"Check to Remove CBC Information
";
false;
# ----------------------------------------
UI_TextSplitter_12 = Custom[UI_TextSplitter](str=code_block_41.out0)
code_block_42 = CodeBlock { ""; }
boolean_input_20 = Custom[Boolean input](InputName=UI_TextSplitter_12, DefaultValue=code_block_41.out1, SideText=code_block_42)
code_block_43 = CodeBlock()
# ---------- code_block_43.designscript (3 lines) ----------
"Check to Remove OSHPD Information
";
false;
# ----------------------------------------
UI_TextSplitter_13 = Custom[UI_TextSplitter](str=code_block_43.out0)
boolean_input_21 = Custom[Boolean input](InputName=UI_TextSplitter_13, DefaultValue=code_block_43.out1, SideText=code_block_42)
code_block_44 = CodeBlock()
# ---------- code_block_44.designscript (3 lines) ----------
"Check to Remove MPLS Healthcare
";
false;
# ----------------------------------------
UI_TextSplitter_14 = Custom[UI_TextSplitter](str=code_block_44.out0)
boolean_input_22 = Custom[Boolean input](InputName=UI_TextSplitter_14, DefaultValue=code_block_44.out1, SideText=code_block_42)
code_block_45 = CodeBlock()
# ---------- code_block_45.designscript (3 lines) ----------
"Check to Remove Wood Details
";
false;
# ----------------------------------------
UI_TextSplitter_15 = Custom[UI_TextSplitter](str=code_block_45.out0)
boolean_input_23 = Custom[Boolean input](InputName=UI_TextSplitter_15, DefaultValue=code_block_45.out1, SideText=code_block_42)
code_block_46 = CodeBlock()
# ---------- code_block_46.designscript (3 lines) ----------
"Check to Remove Planning Sheets
";
false;
# ----------------------------------------
UI_TextSplitter_16 = Custom[UI_TextSplitter](str=code_block_46.out0)
boolean_input_24 = Custom[Boolean input](InputName=UI_TextSplitter_16, DefaultValue=code_block_46.out1, SideText=code_block_42)
create_2 = List.Create(item0=textnote_data, item1=boolean_input, item2=listview_data, item3=dropdown_data_2, item4=boolean_input_2, item5=boolean_input_3, item6=boolean_input_4, item7=boolean_input_5, item8=boolean_input_6, item9=boolean_input_7, item10=boolean_input_8, item11=boolean_input_9, item12=boolean_input_10, item13=boolean_input_11, item14=boolean_input_12, item15=boolean_input_13, item16=boolean_input_14, item17=boolean_input_15, item18=boolean_input_16, item19=boolean_input_17, item20=boolean_input_18, item21=boolean_input_19, item22=filepath_data, item23=textbox_data, item24=textbox_data_2, item25=filepath_data_2, item26=textbox_data_3, item27=textbox_data_4, item28=boolean_input_20, item29=boolean_input_21, item30=boolean_input_22, item31=boolean_input_23, item32=boolean_input_24)
code_block_47 = CodeBlock { "HGA Template Style Selection"; }
file_path_4 = Filename("..\Shared Files\HGA_ClassicLogo_Bug_.png")
fromPath_2 = FileObject(path=file_path_4)  # "File.FromPath"
readFromFile_2 = Image.ReadFromFile(file=fromPath_2)
code_block_48 = CodeBlock { "Run Setup"; }
code_block_49 = CodeBlock()
# ---------- code_block_49.designscript (4 lines) ----------
"Note:";

"REVIT 2024 IS NOW AVAILABLE! Unless an outside discipline does not have this capability, please use the current file.
";
# ----------------------------------------
textnote_data_2 = Custom[TextNote Data](Title=code_block_49.out0, TextNote=code_block_49.out1)
code_block_50 = CodeBlock { "Select a Template Style"; ["Starter Project Lite (additive)", "Custom Production (deductive)"]; }
UI_TextSplitter_17 = Custom[UI_TextSplitter](str=code_block_50.out0)
code_block_51 = CodeBlock { [0,1]; }
code_block_52 = CodeBlock { 1; }
dropdown_data_3 = Custom[DropDown Data](InputName=UI_TextSplitter_17, Keys=code_block_50.out1, Values=code_block_51, DefaultValueIndex=code_block_52)
code_block_53 = CodeBlock { "For and explaination of the template styles above, review the the training article by clicking 'Help' below"; }
textnote_data_3 = Custom[TextNote Data](TextNote=code_block_53)
create_3 = List.Create(item0=textnote_data_2, item1=dropdown_data_3, item2=textnote_data_3)
boolean = BoolSelector(true)
code_block_54 = CodeBlock { "https://hgatechnology.com/46e9jS7"; }
code_block_55 = CodeBlock { "Cancel"; 500; }
code_block_56 = CodeBlock { 800; }
multipleinputform = Custom[MultipleInputForm ++](Description_optional=code_block_47, Logo_optional=readFromFile_2, ButtonText_optional=code_block_48, Inputs=create_3, Toggle=boolean, LinkToHelp_optional=code_block_54, CancelButtonText_optional=code_block_55.out0, MaxHeight_optional=code_block_56)  # package Data-Shapes; Create a form with multiple inputs. see www.data-shapes.net for tutorials and infos!
code_block_57 = CodeBlock(style=multipleinputform.User_Inputs) { style[0]; }
code_block_58 = CodeBlock { 1; }
eq = code_block_57 == code_block_58
code_block_59 = CodeBlock { true; false; }
if_ = If(test=eq, true=code_block_59.out0, false=code_block_59.out1)
code_block_60 = CodeBlock { "Cancel"; 500; }
code_block_61 = CodeBlock { 800; }
multipleinputform_2 = Custom[MultipleInputForm ++](Logo_optional=readFromFile, ButtonText_optional=code_block_8, Inputs=create_2, Toggle=if_, LinkToHelp_optional=code_block_54, CancelButtonText_optional=code_block_60.out0, MaxHeight_optional=code_block_61)
list_create_4 = List.Create(item0=list_create, item1=multipleinputform_2.User_Inputs)
code_block_62 = CodeBlock { true; }
eq_2 = multipleinputform_2.Was_Run == code_block_62
code_block_63 = CodeBlock { 1; 0; }
if_2 = If(test=eq_2, true=code_block_63.out0, false=code_block_63.out1)
getItemAtIndex = List.GetItemAtIndex(list=list_create_4, index=if_2)
passthrough = Custom[Passthrough](passThrough=getItemAtIndex, waitFor=multipleinputform_2.Was_Run)  # package Clockwork for Dynamo 2.x; Forces a sequential order of execution. The node wired into the output of the Passthrough node will be executed *after* the node wired into the waitFor input (e.g. important for some Revit operations). The value of the passThrough input will be passed on to the node wired into the output port of the Passthrough node.
code_block_64 = CodeBlock(confidential=passthrough, removelevels=passthrough, removeareas=passthrough, siteinformation=passthrough, phasingplans=passthrough, demolitionplans=passthrough, slabedges=passthrough, teledatafinishfurniture=passthrough, exteriordetails=passthrough, verticalcirculation=passthrough, mountingheights=passthrough, enlargedplansandelevations=passthrough, restroomshowers=passthrough, interiorpartitiontypesanddetails=passthrough, ceilingdetails=passthrough, caseworkdetails=passthrough, miscellaneousdetails=passthrough, openingtypesschedulesdetails=passthrough, roomfinishandequipmentschedules=passthrough, sheetspecifications=passthrough, labdetails=passthrough, detailrequirements=passthrough, detailsheetname=passthrough, detailstartingcell=passthrough, familyrequirements=passthrough, familysheetname=passthrough, familystartingcell=passthrough, projectcodecbc=passthrough, projectcodeoshpd=passthrough, minneapolishealthcare=passthrough, wooddetails=passthrough, planning=passthrough)
# ---------- code_block_64.designscript (32 lines) ----------
confidential[0];
removelevels[1];
removeareas[2];
siteinformation[3];
phasingplans[4];
demolitionplans[5];
slabedges[6];
teledatafinishfurniture[7];
exteriordetails[8];
verticalcirculation[9];
mountingheights[10];
enlargedplansandelevations[11];
restroomshowers[12];
interiorpartitiontypesanddetails[13];
ceilingdetails[14];
caseworkdetails[15];
miscellaneousdetails[16];
openingtypesschedulesdetails[17];
roomfinishandequipmentschedules[18];
sheetspecifications[20];
labdetails[19];
detailrequirements[21];
detailsheetname[22];
detailstartingcell[23];
familyrequirements[24];
familysheetname[25];
familystartingcell[26];
projectcodecbc[27];
projectcodeoshpd[28];
minneapolishealthcare[29];
wooddetails[30];
planning[31];
# ----------------------------------------
ʳʰʸᵗʰᵐ_system_currentusername = Rhythm.Helpers.System.CurrentUserName()
code_block_65 = CodeBlock { "/"; "_"; }
code_block_66 = CodeBlock { ":"; }
code_block_67 = CodeBlock { "Username"; "Date"; "Time"; "File Path"; }
list_create_5 = List.Create(item0=code_block_67.out0, item1=code_block_67.out1, item2=code_block_67.out2, item3=code_block_67.out3)
create_4 = List.Create(item0=code_block_10.out0, item1=code_block_11.out0, item2=code_block_13, item3=code_block_16.out2, item4=code_block_17.out1, item5=code_block_18.out1, item6=code_block_19.out1, item7=code_block_20.out1, item8=code_block_21.out1, item9=code_block_22.out1, item10=code_block_23.out1, item11=code_block_24.out1, item12=code_block_25.out1, item13=code_block_26.out1, item14=code_block_27.out1, item15=code_block_28.out1, item16=code_block_29.out1, item17=code_block_30.out1, item18=code_block_31.out1, item19=code_block_32.out1, item20=code_block_33.out1, item21=code_block_34, item22=code_block_36.out0, item23=code_block_37.out0, item24=code_block_38, item25=code_block_39.out0, item26=code_block_40.out0, item27=code_block_41.out0, item28=code_block_43.out0, item29=code_block_44.out0, item30=code_block_45.out0, item31=code_block_46.out0)
join = List.Join(list0=list_create_5, list1=create_4)
removeAllWhitespace = dtCore.String.RemoveAllWhitespace(str=join)
transpose = List.Transpose(lists=removeAllWhitespace@L1)
flatten = List.Flatten(list=getItemAtIndex@L2)
nullItem = WombatDynamo.List.NullItem()
if_3 = If(test=eq_2, true=flatten, false=nullItem)
categories = Categories("OST_TitleBlocks")
all_family_types_of_category = Custom[All Family Types Of Category](category=categories)  # package Clockwork for Dynamo 2.x; Gets all family types/symbols of a given category in the model.
code_block_68 = CodeBlock { "OSHPD Increment Description"; ""; 0; }
if_4 = If(test=code_block_64.out28, true=code_block_68.out0, false=code_block_68.out1)
setParameterByName = Element.SetParameterByName(element=all_family_types_of_category, parameterName=if_4, value=code_block_68.out2)
code_block_69 = CodeBlock { "Starting View"; }
sheet_byname = Custom[Sheet ByName](NameOrNumber=code_block_69)  # package Genius Loci; Collects sheets by name or number in the active or given document.

# group: Script Run Data for Starter
code_block_70 = CodeBlock { "Script Revit Version"; "Script Run Date"; }
version = Custom[Application.Version]()  # package Clockwork for Dynamo 2.x; Retrieves the name, version and build of the current Revit application.
string_from_object = FromObject(obj=version.Build)
setParameterByName_2 = Element.SetParameterByName(element=sheet_byname, parameterName=code_block_70.out0, value=string_from_object)
today = DateTime.Today()
string_from_object_2 = FromObject(obj=today)
code_block_71 = CodeBlock { " "; true; }
removeAfterCharacters = dtCore.String.RemoveAfterCharacters(str=string_from_object_2, characters=code_block_71.out0, includeChar=code_block_71.out1)
code_block_72 = CodeBlock { "/"; }
split = String.Split(string=removeAfterCharacters, separator0=code_block_72)
code_block_73 = CodeBlock { 2; 0; 1; }
getItemAtIndex_2 = List.GetItemAtIndex(list=split, index=code_block_73.out0)
code_block_74 = CodeBlock { "."; }
getItemAtIndex_3 = List.GetItemAtIndex(list=split, index=code_block_73.out1)
getItemAtIndex_4 = List.GetItemAtIndex(list=split, index=code_block_73.out2)
concat = String.Concat(string0=getItemAtIndex_2, string1=code_block_74, string2=getItemAtIndex_3, string3=code_block_74, string4=getItemAtIndex_4)
setParameterByName_3 = Element.SetParameterByName(element=setParameterByName_2, parameterName=code_block_70.out1, value=concat)
code_block_75 = CodeBlock { "Save Here - HGA"; }
byFamilyNameAndTypeName = FamilyType.ByFamilyNameAndTypeName(familyName=code_block_75, typeName=code_block_75)
all_elements_of_family_type = ElementsOfFamilyType(Family_Type=byFamilyNameAndTypeName)
code_block_76 = CodeBlock { "Script Was Run Visibility"; }
setParameterByName_4 = Element.SetParameterByName(element=all_elements_of_family_type, parameterName=code_block_76, value=multipleinputform_2.Was_Run)
code_block_77 = CodeBlock { "Confidential Project"; }
setParameterByName_5 = Element.SetParameterByName(element=all_elements_of_family_type, parameterName=code_block_77, value=code_block_64.out0)

# note: CREATED BY: Dan Cesarz
# CREATED: 20180605
# VERSION 1.0
# LAST EDITED: 20180605
# DYNAMO VERSION: <Dynamo 1.3.1>
# PACKAGES:
# <PACKAGES>
# NOTES:
# <NOTES>
# DYNAMO GRAPHIC STANDARD
# CREATED BY: HGA DUG - 2017
hga_usage_tracker = Custom[HGA Usage Tracker]()  # package HGA Usage Tracker; This node tracks usage data relevant to HGA's Digital Practice Group. For questions regarding this data please reach out to the DPG.
code_block_78 = CodeBlock { 2; }
eq_3 = code_block_64.out2 == code_block_78
code_block_79 = CodeBlock { 3; }
eq_4 = code_block_64.out2 == code_block_79
or_ = Or(bool0=eq_3, bool1=eq_4)

# group: Overall and 1/8" Floor Plans
categories_2 = Categories("OST_Sheets")
all_elements_of_category = ElementsOfCategory(Category=categories_2)
sheetNumber = Sheet.SheetNumber(sheet=all_elements_of_category)
code_block_80 = CodeBlock { ".Y"; "ROADBLOCK"; }
contains = String.Contains(string=sheetNumber, searchFor=code_block_80.out0)
filterByBoolMask = List.FilterByBoolMask(list=all_elements_of_category, mask=contains)
code_block_81 = CodeBlock { "Sheet Number"; }
sheetNumber_2 = Sheet.SheetNumber(sheet=filterByBoolMask.in)
length = String.Length(string=sheetNumber_2)
code_block_82 = CodeBlock { 2; }
sub = length - code_block_82
remove = String.Remove(string=sheetNumber_2, startIndex=sub, count=code_block_82)
code_block_83 = CodeBlock { "ROADBLOCK"; ".X"; }
if_5 = RefactoredIf(test=or_, true=code_block_83.out0, false=code_block_83.out1)
contains_2 = String.Contains(string=sheetNumber, searchFor=if_5)
filterByBoolMask_2 = List.FilterByBoolMask(list=all_elements_of_category, mask=contains_2)
views = Sheet.Views(sheet=filterByBoolMask_2.in)
type = Object.Type(object=views)
code_block_84 = CodeBlock { "Plan"; }
contains_3 = String.Contains(string=type, searchFor=code_block_84)
filterByBoolMask_3 = List.FilterByBoolMask(list=views, mask=contains_3)
flatten_2 = List.Flatten(list=filterByBoolMask_3.in)
list_create_6 = List.Create(item0=filterByBoolMask_2.in, item1=flatten_2)
flatten_3 = List.Flatten(list=list_create_6)
delete = Element.Delete(element=flatten_3)
passthrough_2 = Custom[Passthrough](passThrough=remove, waitFor=delete)
setParameterByName_6 = Element.SetParameterByName(element=filterByBoolMask.in, parameterName=code_block_81, value=passthrough_2)
contains_4 = String.Contains(string=sheetNumber, searchFor=code_block_83.out1)
filterByBoolMask_4 = List.FilterByBoolMask(list=all_elements_of_category, mask=contains_4)
sheetNumber_3 = Sheet.SheetNumber(sheet=filterByBoolMask_4.in)
length_2 = String.Length(string=sheetNumber_3)
code_block_85 = CodeBlock { 2; }
sub_2 = length_2 - code_block_85
remove_2 = String.Remove(string=sheetNumber_3, startIndex=sub_2, count=code_block_85)
if_6 = RefactoredIf(test=or_, true=code_block_80.out0, false=code_block_80.out1)
contains_5 = String.Contains(string=sheetNumber, searchFor=if_6)
filterByBoolMask_5 = List.FilterByBoolMask(list=all_elements_of_category, mask=contains_5)
flatten_4 = List.Flatten(list=filterByBoolMask_5.in)
delete_2 = Element.Delete(element=flatten_4)
passthrough_3 = Custom[Passthrough](passThrough=remove_2, waitFor=delete_2)
setParameterByName_7 = Element.SetParameterByName(element=filterByBoolMask_4.in, parameterName=code_block_81, value=passthrough_3)

# group: REMOVE DIMENSION AND NOTATION PLANS
sheetName = Sheet.SheetName(sheet=all_elements_of_category)
code_block_86 = CodeBlock { 1; }
eq_5 = code_block_64.out2 == code_block_86
or_2 = Or(bool0=eq_5, bool1=eq_3)
code_block_87 = CodeBlock { "NOTATION"; "ROADBLOCK"; }
if_7 = RefactoredIf(test=or_2, true=code_block_87.out0, false=code_block_87.out1)
contains_6 = String.Contains(string=sheetName, searchFor=if_7)
filterByBoolMask_6 = List.FilterByBoolMask(list=all_elements_of_category, mask=contains_6)
views_2 = Sheet.Views(sheet=filterByBoolMask_6.in)
type_2 = Object.Type(object=views_2)
code_block_88 = CodeBlock { "Plan"; }
contains_7 = String.Contains(string=type_2, searchFor=code_block_88)
filterByBoolMask_7 = List.FilterByBoolMask(list=views_2, mask=contains_7)
flatten_5 = List.Flatten(list=filterByBoolMask_7.in)
list_create_7 = List.Create(item0=filterByBoolMask_6.in, item1=flatten_5)
flatten_6 = List.Flatten(list=list_create_7)
delete_3 = Element.Delete(element=flatten_6)
passThrough = Custom[PassThrough](passThrough=filterByBoolMask_6.in, waitFor=delete_3)  # package archi-lab.net; Ripped this off from Clockwork. Sorry Andy.
delete_4 = Element.Delete(element=passThrough)
code_block_89 = CodeBlock { "DIMENSION"; "ROADBLOCK"; }
if_8 = RefactoredIf(test=or_2, true=code_block_89.out0, false=code_block_89.out1)
contains_8 = String.Contains(string=sheetName, searchFor=if_8)
filterByBoolMask_8 = List.FilterByBoolMask(list=all_elements_of_category, mask=contains_8)
views_3 = Sheet.Views(sheet=filterByBoolMask_8.in)
type_3 = Object.Type(object=views_3)
code_block_90 = CodeBlock { "Plan"; }
contains_9 = String.Contains(string=type_3, searchFor=code_block_90)
filterByBoolMask_9 = List.FilterByBoolMask(list=views_3, mask=contains_9)
flatten_7 = List.Flatten(list=filterByBoolMask_9.in)
list_create_8 = List.Create(item0=filterByBoolMask_8.in, item1=flatten_7)
flatten_8 = List.Flatten(list=list_create_8)
delete_5 = Element.Delete(element=flatten_8)
passThrough_2 = Custom[PassThrough](passThrough=filterByBoolMask_8.in, waitFor=delete_5)
delete_6 = Element.Delete(element=passThrough_2)

# group: REMOVE OVERALL AND AREA SCOPE BOXES
categories_3 = Categories("OST_VolumeOfInterest")
all_elements_of_category_2 = ElementsOfCategory(Category=categories_3)
name = Element.Name(element=all_elements_of_category_2)
code_block_91 = CodeBlock { "Overall"; "Area A"; "Area B"; "Area C"; "Area D"; }
list_create_9 = List.Create(item0=code_block_91.out0, item1=code_block_91.out1, item2=code_block_91.out2, item3=code_block_91.out3, item4=code_block_91.out4)
code_block_92 = CodeBlock { "ROADBLOCK"; "ROADBLOCK"; "ROADBLOCK"; "ROADBLOCK"; "ROADBLOCK"; }
list_create_10 = List.Create(item0=code_block_92.out0, item1=code_block_92.out1, item2=code_block_92.out2, item3=code_block_92.out3, item4=code_block_92.out4)
if_9 = RefactoredIf(test=eq_5, true=list_create_9, false=list_create_10)
eq_6 = name == if_9  # lacing=CrossProduct
anyTrue = List.AnyTrue(list=eq_6@L2)
filterByBoolMask_10 = List.FilterByBoolMask(list=all_elements_of_category_2, mask=anyTrue)
delete_7 = Element.Delete(element=filterByBoolMask_10.in)

watch = Watch(code_block_64.out1)

# group: Family Requirements
element_types = ElementTypes("Family")
all_elements_of_type = ElementsOfType(element_type=element_types)
boolean_2 = BoolSelector(true)
boolean_3 = BoolSelector(true)
read_excel = Custom[Read Excel](filePath=code_block_64.out24, runIt=boolean_2, sheetName=code_block_64.out25, byColumn=boolean_3, origin=code_block_64.out26)  # package BumbleBee; This node will read an excel file. You can read an entore sheet contents, read from specific origin cell, read only specific range, or do all of the former for multiple sheets at the same time.
code_block_93 = CodeBlock { 0; }
getItemAtIndex_5 = List.GetItemAtIndex(list=read_excel, index=code_block_93)
clear_list = Custom[Clear List](input=getItemAtIndex_5)  # package archi-lab.net; This node will remove all Null and Empty Lists from any list.
sort = List.Sort(list=all_elements_of_type)

name_2 = Element.Name(element=all_elements_of_type)
sortByKey = List.SortByKey(list=all_elements_of_type, keys=name_2)

# group (continued): Family Requirements
string_from_object_3 = FromObject(obj=sortByKey.sortedList)

contains_10 = List.Contains(list=string_from_object_3, item=clear_list, lacing=CrossProduct)

# group (continued): Family Requirements
# note: //families that are listed in excel and found in the project. any that do not have a match will be deleted.
anyTrue_2 = Custom[Booleans.AnyTrue](seq=contains_10)  # package Clockwork for Dynamo 2.x; Returns true if any item in a list of booleans is true.

element_types_2 = ElementTypes("ViewPlan")
all_elements_of_type_2 = ElementsOfType(element_type=element_types_2)
code_block_94 = CodeBlock { "Workset"; }
getParameterValueByName = Element.GetParameterValueByName(element=all_elements_of_type_2, parameterName=code_block_94)
nameFromId = WombatDynamo.Workset.NameFromId(id=getParameterValueByName)
code_block_95 = CodeBlock { "Template"; }
contains_11 = String.Contains(string=nameFromId, searchFor=code_block_95)
filterByBoolMask_11 = List.FilterByBoolMask(list=all_elements_of_type_2, mask=contains_11)

# group: Remove Levels and Associated Views
element_types_3 = ElementTypes("Level")
all_elements_of_type_3 = ElementsOfType(element_type=element_types_3)
code_block_96 = CodeBlock { "Name"; }
getParameterValueByName_2 = Element.GetParameterValueByName(element=all_elements_of_type_3, parameterName=code_block_96)
string_from_object_4 = FromObject(obj=getParameterValueByName_2)
boolean_4 = BoolSelector(true)
code_block_97 = CodeBlock { "Associated Level"; }
getParameterValueByName_3 = Element.GetParameterValueByName(element=filterByBoolMask_11.out, parameterName=code_block_97)
string_from_object_5 = FromObject(obj=getParameterValueByName_3)
boolean_5 = BoolSelector(true)
element_types_4 = ElementTypes("ViewSheet")
all_elements_of_type_4 = ElementsOfType(element_type=element_types_4)
code_block_98 = CodeBlock { "Sheet Name"; }
getParameterValueByName_4 = Element.GetParameterValueByName(element=all_elements_of_type_4, parameterName=code_block_98)
string_from_object_6 = FromObject(obj=getParameterValueByName_4)
boolean_6 = BoolSelector(true)
element_types_5 = ElementTypes("ViewSchedule")
all_elements_of_type_5 = ElementsOfType(element_type=element_types_5)
code_block_99 = CodeBlock { "View Name"; }
getParameterValueByName_5 = Element.GetParameterValueByName(element=all_elements_of_type_5, parameterName=code_block_99)
string_from_object_7 = FromObject(obj=getParameterValueByName_5)
boolean_7 = BoolSelector(true)

containsThisOrThat = dtCore.String.ContainsThisOrThat(str=string_from_object_4, searchFor=watch, ignoreCase=boolean_4)

# group (continued): Remove Levels and Associated Views
filterByBoolMask_12 = List.FilterByBoolMask(list=all_elements_of_type_3, mask=containsThisOrThat)

delete_8 = archilab.Revit.Elements.Elements.Delete(element=filterByBoolMask_12.in)
containsThisOrThat_2 = dtCore.String.ContainsThisOrThat(str=string_from_object_5, searchFor=watch, ignoreCase=boolean_5)

# group (continued): Remove Levels and Associated Views
filterByBoolMask_13 = List.FilterByBoolMask(list=filterByBoolMask_11.out, mask=containsThisOrThat_2)

element_types_6 = ElementTypes("ViewPlan")
all_elements_of_type_6 = ElementsOfType(element_type=element_types_6)
isViewTemplate = Custom[View.IsViewTemplate+](view=all_elements_of_type_6)  # package Clockwork for Dynamo 2.x; Checks if a given view is a view template. Unlike the OOTB node it works for all view types.
filterByBoolMask_14 = List.FilterByBoolMask(list=all_elements_of_type_6, mask=isViewTemplate)
code_block_100 = CodeBlock { "View Name"; }
getParameterValueByName_6 = Element.GetParameterValueByName(element=filterByBoolMask_14.out, parameterName=code_block_100)
code_block_101 = CodeBlock { " - "; }
removeAfterCharacters_2 = dtCore.String.RemoveAfterCharacters(str=getParameterValueByName_6, characters=code_block_101)
element_types_7 = ElementTypes("ViewPlan")
all_elements_of_type_7 = ElementsOfType(element_type=element_types_7)
isViewTemplate_2 = Custom[View.IsViewTemplate+](view=all_elements_of_type_7)
filterByBoolMask_15 = List.FilterByBoolMask(list=all_elements_of_type_7, mask=isViewTemplate_2)
isNull = Object.IsNull(object=filterByBoolMask_15.out)
filterByBoolMask_16 = List.FilterByBoolMask(list=filterByBoolMask_15.out, mask=isNull)
code_block_102 = CodeBlock { "Sheet Number"; }
getParameterValueByName_7 = Element.GetParameterValueByName(element=filterByBoolMask_16.out, parameterName=code_block_102)
nullItem_2 = WombatDynamo.List.NullItem()

# group: Boolean
code_block_103 = CodeBlock(x=code_block_64.out3) { x==true; "A02"; }
if_10 = If(test=code_block_103.out0, true=code_block_103.out1, false=nullItem_2)

nullItem_3 = WombatDynamo.List.NullItem()

# group: Boolean
code_block_104 = CodeBlock(x=code_block_64.out4) { x==true; "G06"; }
if_11 = If(test=code_block_104.out0, true=code_block_104.out1, false=nullItem_3)

nullItem_4 = WombatDynamo.List.NullItem()

# group: Boolean
code_block_105 = CodeBlock(x=code_block_64.out5) { x==true; "A1"; }
if_12 = If(test=code_block_105.out0, true=code_block_105.out1, false=nullItem_4)

nullItem_5 = WombatDynamo.List.NullItem()

# group: Boolean
code_block_106 = CodeBlock(x=code_block_64.out6) { x==true; "A22"; }
if_13 = If(test=code_block_106.out0, true=code_block_106.out1, false=nullItem_5)

nullItem_6 = WombatDynamo.List.NullItem()

# group: Boolean
code_block_107 = CodeBlock(x=code_block_64.out7) { x==true; "A24"; "A26"; "A27"; "A28"; }
create_5 = List.Create(item0=code_block_107.out1, item1=code_block_107.out2, item2=code_block_107.out3, item3=code_block_107.out4)
if_14 = If(test=code_block_107.out0, true=create_5, false=nullItem_6)

nullItem_7 = WombatDynamo.List.NullItem()

# group: Boolean
code_block_108 = CodeBlock(x=code_block_64.out8) { x==true; "A4"; }
if_15 = If(test=code_block_108.out0, true=code_block_108.out1, false=nullItem_7)

nullItem_8 = WombatDynamo.List.NullItem()

# group: Boolean
code_block_109 = CodeBlock(x=code_block_64.out9) { x==true; "A5"; }
if_16 = If(test=code_block_109.out0, true=code_block_109.out1, false=nullItem_8)

nullItem_9 = WombatDynamo.List.NullItem()

# group: Boolean
code_block_110 = CodeBlock(x=code_block_64.out10) { x==true; "A60"; }
if_17 = If(test=code_block_110.out0, true=code_block_110.out1, false=nullItem_9)

nullItem_10 = WombatDynamo.List.NullItem()

# group: Boolean
code_block_111 = CodeBlock(x=code_block_64.out11) { x==true; "A61"; "A62"; "A63"; "A64"; }
create_6 = List.Create(item0=code_block_111.out1, item1=code_block_111.out2, item2=code_block_111.out3, item3=code_block_111.out4)
if_18 = If(test=code_block_111.out0, true=create_6, false=nullItem_10)

nullItem_11 = WombatDynamo.List.NullItem()

# group: Boolean
code_block_112 = CodeBlock(x=code_block_64.out12) { x==true; "A65"; }
if_19 = If(test=code_block_112.out0, true=code_block_112.out1, false=nullItem_11)

nullItem_12 = WombatDynamo.List.NullItem()

# group: Boolean
code_block_113 = CodeBlock(x=code_block_64.out13) { x==true; "A66"; }
if_20 = If(test=code_block_113.out0, true=code_block_113.out1, false=nullItem_12)

nullItem_13 = WombatDynamo.List.NullItem()

# group: Boolean
code_block_114 = CodeBlock(x=code_block_64.out14) { x==true; "A67"; }
if_21 = If(test=code_block_114.out0, true=code_block_114.out1, false=nullItem_13)

nullItem_14 = WombatDynamo.List.NullItem()

# group: Boolean
code_block_115 = CodeBlock(x=code_block_64.out15) { x==true; "A68"; }
if_22 = If(test=code_block_115.out0, true=code_block_115.out1, false=nullItem_14)

nullItem_15 = WombatDynamo.List.NullItem()

# group: Boolean
code_block_116 = CodeBlock(x=code_block_64.out16) { x==true; "A69"; }
if_23 = If(test=code_block_116.out0, true=code_block_116.out1, false=nullItem_15)

nullItem_16 = WombatDynamo.List.NullItem()

# group: Boolean
code_block_117 = CodeBlock(x=code_block_64.out17) { x==true; "A70"; "A71"; }
create_7 = List.Create(item0=code_block_117.out1, item1=code_block_117.out2)
if_24 = If(test=code_block_117.out0, true=create_7, false=nullItem_16)

nullItem_17 = WombatDynamo.List.NullItem()

# group: Boolean
code_block_118 = CodeBlock(x=code_block_64.out18) { x==true; "A72"; "A73"; }

create_8 = List.Create(item0=code_block_118.out1, item1=code_block_118.out2)

# group (continued): Boolean
if_25 = If(test=code_block_118.out0, true=create_8, false=nullItem_17)

nullItem_18 = WombatDynamo.List.NullItem()

# group: Boolean
code_block_119 = CodeBlock(x=code_block_64.out19) { x==true; "A9"; }
if_26 = If(test=code_block_119.out0, true=code_block_119.out1, false=nullItem_18)

nullItem_19 = WombatDynamo.List.NullItem()

# group: Boolean
code_block_120 = CodeBlock(x=code_block_64.out20) { x==true; "A8"; }
if_27 = If(test=code_block_120.out0, true=code_block_120.out1, false=nullItem_19)

nullItem_20 = WombatDynamo.List.NullItem()

# group: Boolean
code_block_121 = CodeBlock(x=code_block_64.out31) { x==true; "P"; }
if_28 = If(test=code_block_121.out0, true=code_block_121.out1, false=nullItem_20)

create_9 = List.Create(item0=if_10, item1=if_11, item2=if_12, item3=if_13, item4=if_14, item5=if_15, item6=if_16, item7=if_17, item8=if_18, item9=if_19, item10=if_20, item11=if_21, item12=if_22, item13=if_23, item14=if_24, item15=if_25, item16=if_26, item17=if_27, item18=if_28)
flatten_9 = List.Flatten(list=create_9)
clear_list_2 = Custom[Clear List](input=flatten_9)
boolean_8 = BoolSelector(true)
containsThisOrThat_3 = dtCore.String.ContainsThisOrThat(str=getParameterValueByName_7, searchFor=clear_list_2, ignoreCase=boolean_8)
filterByBoolMask_17 = List.FilterByBoolMask(list=filterByBoolMask_16.out, mask=containsThisOrThat_3)
getParameterValueByName_8 = Element.GetParameterValueByName(element=filterByBoolMask_17.in, parameterName=code_block_100)
removeAfterCharacters_3 = dtCore.String.RemoveAfterCharacters(str=getParameterValueByName_8, characters=code_block_101)
eq_7 = removeAfterCharacters_2 == removeAfterCharacters_3  # lacing=CrossProduct
anyTrue_3 = Custom[Booleans.AnyTrue](seq=eq_7)
filterByBoolMask_18 = List.FilterByBoolMask(list=filterByBoolMask_14.out, mask=anyTrue_3)
create_10 = List.Create(item0=filterByBoolMask_13.in, item1=filterByBoolMask_18.in)
flatten_10 = List.Flatten(list=create_10)
element_types_8 = ElementTypes("ViewDrafting")
all_elements_of_type_8 = ElementsOfType(element_type=element_types_8)
isNull_2 = Object.IsNull(object=all_elements_of_type_8)
filterByBoolMask_19 = List.FilterByBoolMask(list=all_elements_of_type_8, mask=isNull_2)
code_block_122 = CodeBlock { "Sheet Number"; }
getParameterValueByName_9 = Element.GetParameterValueByName(element=filterByBoolMask_19.out, parameterName=code_block_122)
flatten_11 = List.Flatten(list=create_9)
clear_list_3 = Custom[Clear List](input=flatten_11)
boolean_9 = BoolSelector(true)
containsThisOrThat_4 = dtCore.String.ContainsThisOrThat(str=getParameterValueByName_9, searchFor=clear_list_3, ignoreCase=boolean_9)
filterByBoolMask_20 = List.FilterByBoolMask(list=filterByBoolMask_19.out, mask=containsThisOrThat_4)
flatten_12 = List.Flatten(list=filterByBoolMask_20.in)
containsThisOrThat_5 = dtCore.String.ContainsThisOrThat(str=string_from_object_6, searchFor=watch, ignoreCase=boolean_6)

# group (continued): Remove Levels and Associated Views
filterByBoolMask_21 = List.FilterByBoolMask(list=all_elements_of_type_4, mask=containsThisOrThat_5)

element_types_9 = ElementTypes("ViewSheet")
all_elements_of_type_9 = ElementsOfType(element_type=element_types_9)
isViewTemplate_3 = Custom[View.IsViewTemplate+](view=all_elements_of_type_9)
filterByBoolMask_22 = List.FilterByBoolMask(list=all_elements_of_type_9, mask=isViewTemplate_3)
isNull_3 = Object.IsNull(object=filterByBoolMask_22.out)
filterByBoolMask_23 = List.FilterByBoolMask(list=filterByBoolMask_22.out, mask=isNull_3)
code_block_123 = CodeBlock { "Sheet Number"; }
getParameterValueByName_10 = Element.GetParameterValueByName(element=filterByBoolMask_23.out, parameterName=code_block_123)
flatten_13 = List.Flatten(list=create_9)
clear_list_4 = Custom[Clear List](input=flatten_13)
boolean_10 = BoolSelector(true)
containsThisOrThat_6 = dtCore.String.ContainsThisOrThat(str=getParameterValueByName_10, searchFor=clear_list_4, ignoreCase=boolean_10)
filterByBoolMask_24 = List.FilterByBoolMask(list=filterByBoolMask_23.out, mask=containsThisOrThat_6)
element_types_10 = ElementTypes("ViewSheet")
all_elements_of_type_10 = ElementsOfType(element_type=element_types_10)
isViewTemplate_4 = Custom[View.IsViewTemplate+](view=all_elements_of_type_10)
filterByBoolMask_25 = List.FilterByBoolMask(list=all_elements_of_type_10, mask=isViewTemplate_4)
isNull_4 = Object.IsNull(object=filterByBoolMask_25.out)
filterByBoolMask_26 = List.FilterByBoolMask(list=filterByBoolMask_25.out, mask=isNull_4)
code_block_124 = CodeBlock { "Sheet Number"; }
getParameterValueByName_11 = Element.GetParameterValueByName(element=filterByBoolMask_26.out, parameterName=code_block_124)
flatten_14 = List.Flatten(list=create_9)
clear_list_5 = Custom[Clear List](input=flatten_14)
boolean_11 = BoolSelector(true)
containsThisOrThat_7 = dtCore.String.ContainsThisOrThat(str=getParameterValueByName_11, searchFor=clear_list_5, ignoreCase=boolean_11)
filterByBoolMask_27 = List.FilterByBoolMask(list=filterByBoolMask_26.out, mask=containsThisOrThat_7)
create_11 = List.Create(item0=filterByBoolMask_21.in, item1=filterByBoolMask_24.in, item2=filterByBoolMask_27.in)
flatten_15 = List.Flatten(list=create_11)
element_types_11 = ElementTypes("ViewSection")
all_elements_of_type_11 = ElementsOfType(element_type=element_types_11)
isViewTemplate_5 = Custom[View.IsViewTemplate+](view=all_elements_of_type_11)
filterByBoolMask_28 = List.FilterByBoolMask(list=all_elements_of_type_11, mask=isViewTemplate_5)
isNull_5 = Object.IsNull(object=filterByBoolMask_28.out)
filterByBoolMask_29 = List.FilterByBoolMask(list=filterByBoolMask_28.out, mask=isNull_5)
code_block_125 = CodeBlock { "Sheet Number"; }
getParameterValueByName_12 = Element.GetParameterValueByName(element=filterByBoolMask_29.out, parameterName=code_block_125)
flatten_16 = List.Flatten(list=create_9)
clear_list_6 = Custom[Clear List](input=flatten_16)
boolean_12 = BoolSelector(true)
containsThisOrThat_8 = dtCore.String.ContainsThisOrThat(str=getParameterValueByName_12, searchFor=clear_list_6, ignoreCase=boolean_12)
filterByBoolMask_30 = List.FilterByBoolMask(list=filterByBoolMask_29.out, mask=containsThisOrThat_8)
element_types_12 = ElementTypes("ViewDrafting")
all_elements_of_type_12 = ElementsOfType(element_type=element_types_12)
element_types_13 = ElementTypes("ViewDrafting")
all_elements_of_type_13 = ElementsOfType(element_type=element_types_13)
isViewTemplate_6 = Custom[View.IsViewTemplate+](view=all_elements_of_type_13)
filterByBoolMask_31 = List.FilterByBoolMask(list=all_elements_of_type_13, mask=isViewTemplate_6)
filterByBoolMask_32 = List.FilterByBoolMask(list=all_elements_of_type_12, mask=filterByBoolMask_31.out)
code_block_126 = CodeBlock { "Sheet Name"; }
getParameterValueByName_13 = Element.GetParameterValueByName(element=filterByBoolMask_32.out, parameterName=code_block_126)
flatten_17 = List.Flatten(list=create_9)
clear_list_7 = Custom[Clear List](input=flatten_17)
code_block_127 = CodeBlock { "zMPLS"; }
eq_8 = clear_list_7 == code_block_127
filterByBoolMask_33 = List.FilterByBoolMask(list=clear_list_7, mask=eq_8)
boolean_13 = BoolSelector(true)
containsThisOrThat_9 = dtCore.String.ContainsThisOrThat(str=getParameterValueByName_13, searchFor=filterByBoolMask_33.in, ignoreCase=boolean_13)
filterByBoolMask_34 = List.FilterByBoolMask(list=filterByBoolMask_32.out, mask=containsThisOrThat_9)
containsThisOrThat_10 = dtCore.String.ContainsThisOrThat(str=string_from_object_7, searchFor=watch, ignoreCase=boolean_7)

# group (continued): Remove Levels and Associated Views
filterByBoolMask_35 = List.FilterByBoolMask(list=all_elements_of_type_5, mask=containsThisOrThat_10)

element_types_14 = ElementTypes("ViewSchedule")
all_elements_of_type_14 = ElementsOfType(element_type=element_types_14)
isViewTemplate_7 = Custom[View.IsViewTemplate+](view=all_elements_of_type_14)
filterByBoolMask_36 = List.FilterByBoolMask(list=all_elements_of_type_14, mask=isViewTemplate_7)
isNull_6 = Object.IsNull(object=filterByBoolMask_36.out)
filterByBoolMask_37 = List.FilterByBoolMask(list=filterByBoolMask_36.out, mask=isNull_6)
code_block_128 = CodeBlock { "View Name"; }
getParameterValueByName_14 = Element.GetParameterValueByName(element=filterByBoolMask_37.out, parameterName=code_block_128)

# group: Convert P for Planning
code_block_129 = CodeBlock { "P"; "PLANNING"; }
eq_9 = create_9 == code_block_129.out0
code_block_130 = CodeBlock { true; }
allIndicesOf = List.AllIndicesOf(list=eq_9, item=code_block_130)
replaceItemAtIndex = List.ReplaceItemAtIndex(list=create_9, index=allIndicesOf, item=code_block_129.out1)

flatten_18 = List.Flatten(list=replaceItemAtIndex)
clear_list_8 = Custom[Clear List](input=flatten_18)
boolean_14 = BoolSelector(true)
containsThisOrThat_11 = dtCore.String.ContainsThisOrThat(str=getParameterValueByName_14, searchFor=clear_list_8, ignoreCase=boolean_14)
filterByBoolMask_38 = List.FilterByBoolMask(list=filterByBoolMask_37.out, mask=containsThisOrThat_11)
create_12 = List.Create(item0=filterByBoolMask_35.in, item1=filterByBoolMask_38.in)
flatten_19 = List.Flatten(list=create_12)
view_type = ViewTypesUi("Legend")
getByType = archilab.Revit.Views.Views.GetByType(viewType=view_type)
nullItem_21 = WombatDynamo.List.NullItem()

# group: Boolean
code_block_131 = CodeBlock(x=code_block_64.out19) { x==true; "DOOR HARDWARE"; }
if_29 = If(test=code_block_131.out0, true=code_block_131.out1, false=nullItem_21)

# group: Usage Data to File
string = StringInput("\\hga.int\hga\KBDLibrary\Digital Practice Data Capture")
directory_from_path = DirectoryObject(path=string)
string_2 = StringInput("\\hga.int\hga\KBDLibrary\Digital Practice Data Capture\Hardware")
directory_from_path_2 = DirectoryObject(path=string_2)
if_30 = If(test=code_block_131.out0, true=directory_from_path, false=directory_from_path_2)
code_block_132 = CodeBlock { "/"; }
code_block_133 = CodeBlock { "_"; }
add = ʳʰʸᵗʰᵐ_system_currentusername + code_block_133
now = DateTime.Now()
string_from_object_8 = FromObject(obj=now)
code_block_134 = CodeBlock { " "; }
split_2 = String.Split(string=string_from_object_8, separator0=code_block_134)
firstItem = List.FirstItem(list=split_2)
add_2 = add + firstItem
add_3 = add_2 + code_block_133
code_block_135 = CodeBlock { 1; 2; }
getItemAtIndex_6 = List.GetItemAtIndex(list=split_2, index=code_block_135.out0)
add_4 = add_3 + getItemAtIndex_6
code_block_136 = CodeBlock { true; }
code_block_137 = CodeBlock { "Starter Project Data Capture"; "A1"; }
getItemAtIndex_7 = List.GetItemAtIndex(list=split_2, index=code_block_135.out1)
join_2 = String.Join(separator=code_block_134, string0=getItemAtIndex_6, string1=getItemAtIndex_7)
current = Document.Current()
filePath = Document.FilePath(document=current)
join_3 = List.Join(list0=ʳʰʸᵗʰᵐ_system_currentusername, list1=firstItem, list2=join_2, list3=filePath)

replace = String.Replace(string=add_4, searchFor=code_block_65.out0, replaceWith=code_block_65.out1)
replace_2 = String.Replace(string=replace, searchFor=code_block_66, replaceWith=code_block_65.out1)

# group (continued): Usage Data to File
add_5 = code_block_132 + replace_2
add_6 = if_30 + add_5

join_4 = List.Join(list0=join_3, list1=if_3)
transpose_2 = List.Transpose(lists=join_4@L2)
list_create_11 = List.Create(item0=transpose, item1=transpose_2)
transpose_3 = List.Transpose(lists=list_create_11)
flatten_20 = List.Flatten(list=transpose_3@L3)

# group (continued): Usage Data to File
bb_data = Custom[BB Data](sheetName=code_block_137.out0, origin=code_block_137.out1, data=flatten_20)  # package BumbleBee; This node is a building block for different modes of writing to Excel files. You can combines this node into a list to write to multiple sheets or use just one to write to a single sheet.
write_excel = Custom[Write Excel](filePath=add_6, runIt=code_block_136, BBData=bb_data)  # package BumbleBee; This node will write data to Excel file and based on how your BBData nodes are structured it will either override the exsting file, create a new one and write a single worksheet or write multiple worksheets.

# group: Keep Door Hardware When Sheet Specs Are Used (temporary)
code_block_138 = CodeBlock { "View Name"; }
getParameterValueByName_15 = Element.GetParameterValueByName(element=getByType, parameterName=code_block_138)
contains_12 = String.Contains(string=getParameterValueByName_15, searchFor=if_29)
filterByBoolMask_39 = List.FilterByBoolMask(list=getByType, mask=contains_12)

nullItem_22 = WombatDynamo.List.NullItem()

# group: Boolean
code_block_139 = CodeBlock(x=code_block_64.out29) { x==true; "zMPLS"; }
if_31 = If(test=code_block_139.out0, true=code_block_139.out1, false=nullItem_22)

# group: MPLS HC
element_types_15 = ElementTypes("ViewSheet")
all_elements_of_type_15 = ElementsOfType(element_type=element_types_15)
isViewTemplate_8 = Custom[View.IsViewTemplate+](view=all_elements_of_type_15)
filterByBoolMask_40 = List.FilterByBoolMask(list=all_elements_of_type_15, mask=isViewTemplate_8)
isNull_7 = Object.IsNull(object=filterByBoolMask_40.out)
filterByBoolMask_41 = List.FilterByBoolMask(list=filterByBoolMask_40.out, mask=isNull_7)
code_block_140 = CodeBlock { "Sheet Name"; }
getParameterValueByName_16 = Element.GetParameterValueByName(element=filterByBoolMask_41.out, parameterName=code_block_140)
flatten_21 = List.Flatten(list=if_31)
clear_list_9 = Custom[Clear List](input=flatten_21)
boolean_15 = BoolSelector(true)
containsThisOrThat_12 = dtCore.String.ContainsThisOrThat(str=getParameterValueByName_16, searchFor=clear_list_9, ignoreCase=boolean_15)
filterByBoolMask_42 = List.FilterByBoolMask(list=filterByBoolMask_41.out, mask=containsThisOrThat_12)
element_types_16 = ElementTypes("ViewDrafting")
all_elements_of_type_16 = ElementsOfType(element_type=element_types_16)
isViewTemplate_9 = Custom[View.IsViewTemplate+](view=all_elements_of_type_16)
filterByBoolMask_43 = List.FilterByBoolMask(list=all_elements_of_type_16, mask=isViewTemplate_9)
isNull_8 = Object.IsNull(object=filterByBoolMask_43.out)
filterByBoolMask_44 = List.FilterByBoolMask(list=filterByBoolMask_43.out, mask=isNull_8)
code_block_141 = CodeBlock { "Type"; }
getParameterValueByName_17 = Element.GetParameterValueByName(element=filterByBoolMask_44.out, parameterName=code_block_141)
name_3 = Element.Name(element=getParameterValueByName_17)
flatten_22 = List.Flatten(list=if_31)
clear_list_10 = Custom[Clear List](input=flatten_22)
boolean_16 = BoolSelector(true)
containsThisOrThat_13 = dtCore.String.ContainsThisOrThat(str=name_3, searchFor=clear_list_10, ignoreCase=boolean_16)
filterByBoolMask_45 = List.FilterByBoolMask(list=filterByBoolMask_44.out, mask=containsThisOrThat_13)
element_types_17 = ElementTypes("ViewSchedule")
all_elements_of_type_17 = ElementsOfType(element_type=element_types_17)
isViewTemplate_10 = Custom[View.IsViewTemplate+](view=all_elements_of_type_17)
code_block_142 = CodeBlock { false; }
replaceNull = Custom[List.ReplaceNull](seq=isViewTemplate_10, replacement=code_block_142)  # package Clockwork for Dynamo 2.x; Replaces all null values within a given list with a substitute
filterByBoolMask_46 = List.FilterByBoolMask(list=all_elements_of_type_17, mask=replaceNull)
isNull_9 = Object.IsNull(object=filterByBoolMask_46.out)
filterByBoolMask_47 = List.FilterByBoolMask(list=filterByBoolMask_46.out, mask=isNull_9)
code_block_143 = CodeBlock { "View Name"; }
getParameterValueByName_18 = Element.GetParameterValueByName(element=filterByBoolMask_47.out, parameterName=code_block_143)
flatten_23 = List.Flatten(list=if_31)
clear_list_11 = Custom[Clear List](input=flatten_23)
boolean_17 = BoolSelector(true)
containsThisOrThat_14 = dtCore.String.ContainsThisOrThat(str=getParameterValueByName_18, searchFor=clear_list_11, ignoreCase=boolean_17)
filterByBoolMask_48 = List.FilterByBoolMask(list=filterByBoolMask_47.out, mask=containsThisOrThat_14)
create_13 = List.Create(item0=filterByBoolMask_42.in, item1=filterByBoolMask_45.in, item2=filterByBoolMask_48.in)
flatten_24 = List.Flatten(list=create_13)

# group: 24_0404
# wait until details are removed, then see what families are still being used.  If used or are listed in the discipline excel, they will remain.
code_block_144 = CodeBlock { 0; }
count = List.Count(list=sortByKey.sortedList)
cycle = List.Cycle(list=code_block_144, amount=count)
element_types_18 = ElementTypes("FamilyInstance")
all_elements_of_type_18 = ElementsOfType(element_class=element_types_18)
list_create_12 = List.Create(item0=flatten_10, item1=flatten_12, item2=flatten_15, item3=filterByBoolMask_30.in, item4=filterByBoolMask_34.in, item5=flatten_19, item6=filterByBoolMask_39.in, item7=flatten_24)
delete_9 = Element.Delete(element=list_create_12)
passthrough_4 = Custom[Passthrough](passThrough=all_elements_of_type_18, waitFor=delete_9)
getFamily = FamilyInstance.GetFamily(familyInstance=passthrough_4)
groupByKey = List.GroupByKey(list=getFamily, keys=getFamily)
allIndicesOf_2 = List.AllIndicesOf(list=groupByKey.uniqueKeys, item=sortByKey.sortedList)
isEmpty = List.IsEmpty(list=allIndicesOf_2@L2)
code_block_145 = CodeBlock { false; }
allIndicesOf_3 = List.AllIndicesOf(list=isEmpty, item=code_block_145)
getItemAtIndex_8 = List.GetItemAtIndex(list=groupByKey.groups, index=allIndicesOf_2)
count_2 = List.Count(list=getItemAtIndex_8@L2)
replaceItemAtIndex_2 = archilab.Lists.Lists.ReplaceItemAtIndex(list=cycle, index=allIndicesOf_3, item=count_2)
code_block_146 = CodeBlock { 0; }
gt = replaceItemAtIndex_2 > code_block_146
create_14 = List.Create(item0=anyTrue_2, item1=gt)
transpose_4 = List.Transpose(lists=create_14)
anyTrue_4 = Custom[Booleans.AnyTrue](seq=transpose_4)
filterByBoolMask_49 = List.FilterByBoolMask(list=sortByKey.sortedList, mask=anyTrue_4)
delete_10 = archilab.Revit.Elements.Elements.Delete(element=filterByBoolMask_49.out)

nullItem_23 = WombatDynamo.List.NullItem()

# group: Boolean
code_block_147 = CodeBlock(x=code_block_64.out27) { x==true; "CBC"; }
if_32 = If(test=code_block_147.out0, true=code_block_147.out1, false=nullItem_23)

# group: Remove Code: CBC
element_types_19 = ElementTypes("TextNoteType")
all_elements_of_type_19 = ElementsOfType(element_type=element_types_19)
code_block_148 = CodeBlock { "Type Name"; }
getParameterValueByName_19 = Element.GetParameterValueByName(element=all_elements_of_type_19, parameterName=code_block_148)
string_from_object_9 = FromObject(obj=getParameterValueByName_19)
contains_13 = String.Contains(string=string_from_object_9, searchFor=if_32)
filterByBoolMask_50 = List.FilterByBoolMask(list=all_elements_of_type_19, mask=contains_13)

delete_11 = archilab.Revit.Elements.Elements.Delete(element=filterByBoolMask_50.in)
nullItem_24 = WombatDynamo.List.NullItem()

# group: Boolean
code_block_149 = CodeBlock(x=code_block_64.out28) { x==true; "OSHPD"; }
if_33 = If(test=code_block_149.out0, true=code_block_149.out1, false=nullItem_24)

# group: Remove Code: OSHPD
element_types_20 = ElementTypes("TextNoteType")
all_elements_of_type_20 = ElementsOfType(element_type=element_types_20)
code_block_150 = CodeBlock { "Type Name"; }
getParameterValueByName_20 = Element.GetParameterValueByName(element=all_elements_of_type_20, parameterName=code_block_150)
string_from_object_10 = FromObject(obj=getParameterValueByName_20)
contains_14 = String.Contains(string=string_from_object_10, searchFor=if_33)
filterByBoolMask_51 = List.FilterByBoolMask(list=all_elements_of_type_20, mask=contains_14)

delete_12 = archilab.Revit.Elements.Elements.Delete(element=filterByBoolMask_51.in)
code_block_151 = CodeBlock {  }
code_block_152 = CodeBlock {  }

# group: Detail Requirements
element_types_21 = ElementTypes("ViewDrafting")
all_elements_of_type_21 = ElementsOfType(element_type=element_types_21)
code_block_153 = CodeBlock { "View Name"; }
boolean_18 = BoolSelector(true)
boolean_19 = BoolSelector(true)
read_excel_2 = Custom[Read Excel](filePath=code_block_64.out21, runIt=boolean_18, sheetName=code_block_64.out22, byColumn=boolean_19, origin=code_block_64.out23)
code_block_154 = CodeBlock { 2; }
getItemAtIndex_9 = List.GetItemAtIndex(list=read_excel_2, index=code_block_154)
code_block_155 = CodeBlock { "All Details Master"; }
read_excel_3 = Custom[Read Excel](filePath=code_block_64.out21, runIt=boolean_18, sheetName=code_block_155, byColumn=boolean_19, origin=code_block_64.out23)
code_block_156 = CodeBlock { 2; }
getItemAtIndex_10 = List.GetItemAtIndex(list=read_excel_3, index=code_block_156)

code_block_157 = CodeBlock { "Workset"; }
getParameterValueByName_21 = Element.GetParameterValueByName(element=all_elements_of_type_21, parameterName=code_block_157)
nameFromId_2 = WombatDynamo.Workset.NameFromId(id=getParameterValueByName_21)
code_block_158 = CodeBlock { "Template"; }
contains_15 = String.Contains(string=nameFromId_2, searchFor=code_block_158)
filterByBoolMask_52 = List.FilterByBoolMask(list=all_elements_of_type_21, mask=contains_15)

# group (continued): Detail Requirements
getParameterValueByName_22 = Element.GetParameterValueByName(element=filterByBoolMask_52.out, parameterName=code_block_153)

code_block_159 = CodeBlock { " "; }
replaceNull_2 = Custom[List.ReplaceNull](seq=getItemAtIndex_9, replacement=code_block_159)
contains_16 = List.Contains(list=getParameterValueByName_22, item=replaceNull_2, lacing=CrossProduct)
anyTrue_5 = Custom[Booleans.AnyTrue](seq=contains_16)
replaceNull_3 = Custom[List.ReplaceNull](seq=getItemAtIndex_10, replacement=code_block_159)
contains_17 = List.Contains(list=getParameterValueByName_22, item=replaceNull_3, lacing=CrossProduct)
allFalse = List.AllFalse(list=contains_17@L2)

# group (continued): Detail Requirements
create_15 = List.Create(item0=anyTrue_5, item1=allFalse)
transpose_5 = List.Transpose(lists=create_15)
anyTrue_6 = Custom[Booleans.AnyTrue](seq=transpose_5)
filterByBoolMask_53 = List.FilterByBoolMask(list=filterByBoolMask_52.out, mask=anyTrue_6)

delete_13 = archilab.Revit.Elements.Elements.Delete(element=filterByBoolMask_53.out)

# group: 24_0116 Remove Sheets if Empty
isEmpty_2 = List.IsEmpty(list=delete_13)
code_block_160 = CodeBlock { "No Sheets"; "Sheets"; }
if_34 = RefactoredIf(test=isEmpty_2, true=code_block_160.out0, false=code_block_160.out1)
byName = Category.ByName(name=if_34)
all_elements_of_category_3 = ElementsOfCategory(Category=byName)
views_4 = Sheet.Views(sheet=all_elements_of_category_3)
isEmpty_3 = List.IsEmpty(list=views_4@L2)
filterByBoolMask_54 = List.FilterByBoolMask(list=all_elements_of_category_3, mask=isEmpty_3)
delete_14 = Element.Delete(element=filterByBoolMask_54.in)

# group: 24_0422
# Removal of lab area schemes if non lab project
element_classes = ElementTypes("AreaScheme")
all_elements_of_class = ElementsOfType(element_class=element_classes)
name_4 = Element.Name(element=all_elements_of_class)
code_block_161 = CodeBlock { "Lab"; true; }
contains_18 = String.Contains(string=name_4, searchFor=code_block_161.out0, ignoreCase=code_block_161.out1)
filterByBoolMask_55 = List.FilterByBoolMask(list=all_elements_of_class, mask=contains_18)
code_block_162 = CodeBlock { []; }
list_create_13 = List.Create(item0=filterByBoolMask_55.in, item1=code_block_162)
code_block_163 = CodeBlock { true; }
eq_10 = code_block_64.out20 == code_block_163
code_block_164 = CodeBlock { 0; 1; }
if_35 = RefactoredIf(test=eq_10, true=code_block_164.out0, false=code_block_164.out1)
getItemAtIndex_11 = List.GetItemAtIndex(list=list_create_13, index=if_35)
delete_15 = archilab.Revit.Elements.Elements.Delete(element=getItemAtIndex_11)
