# Dynamo graph Mechanical Starter_Project Setup v24_0129_script.dyn "Mechanical Starter_Project Setup v24_0129" (Dynamo 2.19.3.6394)
# author: HGA DPG
# Use this script to customize the HGA starter project based on your project needs.
# packages: Data-Shapes 2022.2.103, Clockwork for Dynamo 2.x 2.4.0, archi-lab.net 2023.213.1523, HGA Usage Tracker 1.0.0, Rhythm 2022.9.1, designtech 1.0.8, WombatDynamo 2.3.5

hga_usage_tracker = Custom[HGA Usage Tracker]()  # package HGA Usage Tracker
sheets = Sheets("!! : Starting View")
code_block = CodeBlock { "HGA Production Setup"; }
file_path = Filename("..\Shared Files\HGA_ClassicLogo_Bug_.png")
fromPath = FileObject(path=file_path)  # "File.FromPath"
readFromFile = Image.ReadFromFile(file=fromPath)
code_block_2 = CodeBlock { "Run Setup"; }
code_block_3 = CodeBlock { "Is this project confidential?:"; true; "Check box for Yes(or possibly)/Leave unchecked for No"; }
UI_TextSplitter = Custom[UI_TextSplitter](str=code_block_3.out0)  # package HGA Usage Tracker
boolean_input = Custom[Boolean input](InputName=UI_TextSplitter, DefaultValue=code_block_3.out1, SideText=code_block_3.out2)  # package Data-Shapes

# group: Add back in if multiple levels are added
code_block_4 = CodeBlock()
# ---------- code_block_4.designscript (2 lines) ----------
"Check Levels to Remove:";
["Lower Level","Level 01","Level 02","Level 03","Level 04","Level 05", "Level 06", "Level 07", "Level 08", "ROOF"];
# ----------------------------------------
UI_TextSplitter_2 = Custom[UI_TextSplitter](str=code_block_4.out0)
code_block_5 = CodeBlock { false; }
listview_data = Custom[Listview Data](InputName=UI_TextSplitter_2, Keys=code_block_4.out1, Values=code_block_4.out1, SortItems_optionnal=code_block_5)  # package Data-Shapes

code_block_6 = CodeBlock { "Will the project require overall / area plans?:"; true; "Check box for Yes(or possibly)/Leave unchecked for No"; }
UI_TextSplitter_3 = Custom[UI_TextSplitter](str=code_block_6.out0)
boolean_input_2 = Custom[Boolean input](InputName=UI_TextSplitter_3, DefaultValue=code_block_6.out1, SideText=code_block_6.out2)
code_block_7 = CodeBlock { "Check to Remove:"; false; "    Mechanical Content"; }
UI_TextSplitter_4 = Custom[UI_TextSplitter](str=code_block_7.out0)
boolean_input_3 = Custom[Boolean input](InputName=UI_TextSplitter_4, DefaultValue=code_block_7.out1, SideText=code_block_7.out2)
code_block_8 = CodeBlock { "Check to Remove:"; false; "    Plumbing Content"; }
UI_TextSplitter_5 = Custom[UI_TextSplitter](str=code_block_8.out0)
boolean_input_4 = Custom[Boolean input](InputName=UI_TextSplitter_5, DefaultValue=code_block_8.out1, SideText=code_block_8.out2)
code_block_9 = CodeBlock { "Check to Remove:"; }
UI_TextSplitter_6 = Custom[UI_TextSplitter](str=code_block_9)
code_block_10 = CodeBlock { "Details"; "Schedules"; "Sheets"; }
create = List.Create(item0=code_block_10.out0, item1=code_block_10.out1, item2=code_block_10.out2)
code_block_11 = CodeBlock { "Detail"; "Schedule"; "Sheet"; }
create_2 = List.Create(item0=code_block_11.out0, item1=code_block_11.out1, item2=code_block_11.out2)
code_block_12 = CodeBlock { false; }
listview_data_2 = Custom[Listview Data](InputName=UI_TextSplitter_6, Keys=create, Values=create_2, SortItems_optionnal=code_block_12)
code_block_13 = CodeBlock { "Check to Remove:"; }
UI_TextSplitter_7 = Custom[UI_TextSplitter](str=code_block_13)
code_block_14 = CodeBlock { "Demo Content"; "Med Gas Content"; "California Content"; "Controls"; }
create_3 = List.Create(item0=code_block_14.out0, item1=code_block_14.out1, item2=code_block_14.out2, item3=code_block_14.out3)
code_block_15 = CodeBlock { "Demo"; "Med Gas"; "California"; "Controls"; }
create_4 = List.Create(item0=code_block_15.out0, item1=code_block_15.out1, item2=code_block_15.out2, item3=code_block_15.out3)
listview_data_3 = Custom[Listview Data](InputName=UI_TextSplitter_7, Keys=create_3, Values=create_4, SortItems_optionnal=code_block_12)
create_5 = List.Create(item0=boolean_input, item1=listview_data, item2=boolean_input_2, item3=boolean_input_3, item4=boolean_input_4, item5=listview_data_2, item6=listview_data_3)
code_block_16 = CodeBlock { true; }
code_block_17 = CodeBlock { "Cancel"; }
multipleinputform = Custom[MultipleInputForm ++](Description_optional=code_block, Logo_optional=readFromFile, ButtonText_optional=code_block_2, Inputs=create_5, Toggle=code_block_16, CancelButtonText_optional=code_block_17)  # package Data-Shapes

# group: Script Run Data for Starter
code_block_18 = CodeBlock { "Script Revit Version"; "Script Run Date"; }
version = Custom[Application.Version]()  # package Clockwork for Dynamo 2.x
string_from_object = FromObject(obj=version.Build)
setParameterByName = Element.SetParameterByName(element=sheets.out2, parameterName=code_block_18.out0, value=string_from_object)
today = DateTime.Today()
string_from_object_2 = FromObject(obj=today)
code_block_19 = CodeBlock { " "; true; }
code_block_20 = CodeBlock { "/"; }
code_block_21 = CodeBlock { 2; 0; 1; }
code_block_22 = CodeBlock { "."; }
code_block_23 = CodeBlock { "Save Here - HGA"; }
byFamilyNameAndTypeName = FamilyType.ByFamilyNameAndTypeName(familyName=code_block_23, typeName=code_block_23)
all_elements_of_family_type = ElementsOfFamilyType(Family_Type=byFamilyNameAndTypeName)
code_block_24 = CodeBlock { "Script Was Run Visibility"; }
setParameterByName_2 = Element.SetParameterByName(element=all_elements_of_family_type, parameterName=code_block_24, value=multipleinputform.Was_Run)

removeAfterCharacters = dtCore.String.RemoveAfterCharacters(str=string_from_object_2, characters=code_block_19.out0, includeChar=code_block_19.out1)

# group (continued): Script Run Data for Starter
split = String.Split(string=removeAfterCharacters, separator0=code_block_20)
getItemAtIndex = List.GetItemAtIndex(list=split, index=code_block_21.out0)
getItemAtIndex_2 = List.GetItemAtIndex(list=split, index=code_block_21.out1)
getItemAtIndex_3 = List.GetItemAtIndex(list=split, index=code_block_21.out2)
concat = String.Concat(string0=getItemAtIndex, string1=code_block_22, string2=getItemAtIndex_2, string3=code_block_22, string4=getItemAtIndex_3)
setParameterByName_3 = Element.SetParameterByName(element=setParameterByName, parameterName=code_block_18.out1, value=concat)

code_block_25 = CodeBlock { "Confidential Project"; }
code_block_26 = CodeBlock(confidential=multipleinputform.User_Inputs, removelevels=multipleinputform.User_Inputs, areaplans=multipleinputform.User_Inputs, removemech=multipleinputform.User_Inputs, removeplumb=multipleinputform.User_Inputs, removedss=multipleinputform.User_Inputs, removebykeyword=multipleinputform.User_Inputs) { confidential[0]; removelevels[1]; areaplans[2]; removemech[3]; removeplumb[4]; removedss[5]; removebykeyword[6]; }
setParameterByName_4 = Element.SetParameterByName(element=all_elements_of_family_type, parameterName=code_block_25, value=code_block_26.out0)
watch = Watch(code_block_26.out1)

# group: Overall and 1/8" Floor Plans
categories = Categories("OST_Sheets")
all_elements_of_category = ElementsOfCategory(Category=categories)
sheetNumber = Sheet.SheetNumber(sheet=all_elements_of_category)
code_block_27 = CodeBlock { "ROADBLOCK"; ".X"; }
contains = String.Contains(string=sheetNumber, searchFor=code_block_27.out1)
filterByBoolMask = List.FilterByBoolMask(list=all_elements_of_category, mask=contains)
code_block_28 = CodeBlock { "Sheet Number"; }
sheetNumber_2 = Sheet.SheetNumber(sheet=filterByBoolMask.in)
length = String.Length(string=sheetNumber_2)
code_block_29 = CodeBlock { 2; }
sub = length - code_block_29
remove = String.Remove(string=sheetNumber_2, startIndex=sub, count=code_block_29)
code_block_30 = CodeBlock { ".Y"; "ROADBLOCK"; }
if_ = RefactoredIf(test=code_block_26.out2, true=code_block_30.out0, false=code_block_30.out1)
contains_2 = String.Contains(string=sheetNumber, searchFor=if_)
filterByBoolMask_2 = List.FilterByBoolMask(list=all_elements_of_category, mask=contains_2)
flatten = List.Flatten(list=filterByBoolMask_2.in)
delete = Element.Delete(element=flatten)
passthrough = Custom[Passthrough](passThrough=remove, waitFor=delete)  # package Clockwork for Dynamo 2.x
setParameterByName_5 = Element.SetParameterByName(element=filterByBoolMask.in, parameterName=code_block_28, value=passthrough)
contains_3 = String.Contains(string=sheetNumber, searchFor=code_block_30.out0)
filterByBoolMask_3 = List.FilterByBoolMask(list=all_elements_of_category, mask=contains_3)
sheetNumber_3 = Sheet.SheetNumber(sheet=filterByBoolMask_3.in)
length_2 = String.Length(string=sheetNumber_3)
code_block_31 = CodeBlock { 2; }
sub_2 = length_2 - code_block_31
remove_2 = String.Remove(string=sheetNumber_3, startIndex=sub_2, count=code_block_31)
if_2 = RefactoredIf(test=code_block_26.out2, true=code_block_27.out0, false=code_block_27.out1)
contains_4 = String.Contains(string=sheetNumber, searchFor=if_2)
filterByBoolMask_4 = List.FilterByBoolMask(list=all_elements_of_category, mask=contains_4)
views = Sheet.Views(sheet=filterByBoolMask_4.in)
type = Object.Type(object=views)
code_block_32 = CodeBlock { "Plan"; }
contains_5 = String.Contains(string=type, searchFor=code_block_32)
filterByBoolMask_5 = List.FilterByBoolMask(list=views, mask=contains_5)
flatten_2 = List.Flatten(list=filterByBoolMask_5.in)
list_create = List.Create(item0=filterByBoolMask_4.in, item1=flatten_2)
flatten_3 = List.Flatten(list=list_create)
delete_2 = Element.Delete(element=flatten_3)
passthrough_2 = Custom[Passthrough](passThrough=remove_2, waitFor=delete_2)
setParameterByName_6 = Element.SetParameterByName(element=filterByBoolMask_3.in, parameterName=code_block_28, value=passthrough_2)

code_block_33 = CodeBlock { true; }
eq = code_block_26.out4 == code_block_33
code_block_34 = CodeBlock { true; }
eq_2 = code_block_26.out3 == code_block_34

# group: 24_0129
categories_2 = Categories("OST_DuctSystem")
all_elements_of_category_2 = ElementsOfCategory(Category=categories_2)
element_classes = ElementTypes("Duct")
all_elements_of_class = ElementsOfType(element_class=element_classes)
element_classes_2 = ElementTypes("Family")
all_elements_of_class_2 = ElementsOfType(element_class=element_classes_2)
category = Custom[Element.Category+](element=all_elements_of_class_2)  # package Clockwork for Dynamo 2.x
string_from_object_3 = FromObject(object=category.category)
code_block_35 = CodeBlock { "Air"; "Duct"; "Mechanical"; }
list_create_2 = List.Create(item0=code_block_35.out0, item1=code_block_35.out1, item2=code_block_35.out2)
contains_6 = String.Contains(string=string_from_object_3, searchFor=list_create_2, lacing=CrossProduct)
anyTrue = List.AnyTrue(list=contains_6@L2)
filterByBoolMask_6 = List.FilterByBoolMask(list=all_elements_of_class_2, mask=anyTrue)
list_create_3 = List.Create(item0=all_elements_of_category_2, item1=all_elements_of_class, item2=filterByBoolMask_6.in)
flatten_4 = List.Flatten(list=list_create_3)
string_from_object_4 = FromObject(object=category.category)
code_block_36 = CodeBlock { "Pipe"; "Plumbing"; }
list_create_4 = List.Create(item0=code_block_36.out0, item1=code_block_36.out1)
contains_7 = String.Contains(string=string_from_object_4, searchFor=list_create_4, lacing=CrossProduct)
anyTrue_2 = List.AnyTrue(list=contains_7@L2)
filterByBoolMask_7 = List.FilterByBoolMask(list=all_elements_of_class_2, mask=anyTrue_2)
categories_3 = Categories("OST_PipingSystem")
all_elements_of_category_3 = ElementsOfCategory(Category=categories_3)
element_classes_3 = ElementTypes("Pipe")
all_elements_of_class_3 = ElementsOfType(element_class=element_classes_3)
list_create_5 = List.Create(item0=filterByBoolMask_7.in, item1=all_elements_of_category_3, item2=all_elements_of_class_3)
flatten_5 = List.Flatten(list=list_create_5)
list_create_6 = List.Create(item0=flatten_4, item1=flatten_5)
code_block_37 = CodeBlock { 1; 20; }
if_3 = RefactoredIf(test=eq, true=code_block_37.out0, false=code_block_37.out1)
getItemAtIndex_4 = List.GetItemAtIndex(list=list_create_6, index=if_3)
delete_3 = Element.Delete(element=getItemAtIndex_4)
code_block_38 = CodeBlock { 0; 20; }
if_4 = RefactoredIf(test=eq_2, true=code_block_38.out0, false=code_block_38.out1)
getItemAtIndex_5 = List.GetItemAtIndex(list=list_create_6, index=if_4)
delete_4 = Element.Delete(element=getItemAtIndex_5)
filterByBoolMask_8 = List.FilterByBoolMask(list=string_from_object_4, mask=anyTrue_2)
filterByBoolMask_9 = List.FilterByBoolMask(list=string_from_object_3, mask=anyTrue)

elementType = Element.ElementType(element=all_elements_of_category_2)
elementType_2 = Element.ElementType(element=all_elements_of_category_2)
element_types = ElementTypes("Family")
all_elements_of_type = ElementsOfType(element_type=element_types)
code_block_39 = CodeBlock { "Keywords"; }
getParameterValueByName = Element.GetParameterValueByName(element=all_elements_of_type, parameterName=code_block_39)
code_block_40 = CodeBlock { "Mechanical"; "RoadBlock"; }
if_5 = RefactoredIf(test=eq_2, true=code_block_40.out0, false=code_block_40.out1)
code_block_41 = CodeBlock { "Plumbing"; "RoadBlock"; }
if_6 = RefactoredIf(test=eq, true=code_block_41.out0, false=code_block_41.out1)
create_6 = List.Create(item0=if_5, item1=if_6, item2=code_block_26.out6, item3=code_block_26.out5)
flatten_6 = List.Flatten(list=create_6)
containsThisOrThat = dtCore.String.ContainsThisOrThat(str=getParameterValueByName, searchFor=flatten_6, lacing=CrossProduct)
anyTrue_3 = Custom[List.AnyTrue](seq=containsThisOrThat)  # package Clockwork for Dynamo 2.x
clear_list = Custom[Clear List](input=anyTrue_3)  # package archi-lab.net
flatten_7 = List.Flatten(list=clear_list)
filterByBoolMask_10 = List.FilterByBoolMask(list=all_elements_of_type, mask=flatten_7)
element_types_2 = ElementTypes("ViewSheet")
all_elements_of_type_2 = ElementsOfType(element_type=element_types_2)
element_types_3 = ElementTypes("ViewPlan")
all_elements_of_type_3 = ElementsOfType(element_type=element_types_3)
create_7 = List.Create(item0=all_elements_of_type_2, item1=all_elements_of_type_3)
flatten_8 = List.Flatten(list=create_7)
code_block_42 = CodeBlock { "Keywords"; }
getParameterValueByName_2 = Element.GetParameterValueByName(element=flatten_8, parameterName=code_block_42)
containsThisOrThat_2 = dtCore.String.ContainsThisOrThat(str=getParameterValueByName_2, searchFor=flatten_6, lacing=CrossProduct)
anyTrue_4 = Custom[List.AnyTrue](seq=containsThisOrThat_2)
clear_list_2 = Custom[Clear List](input=anyTrue_4)
flatten_9 = List.Flatten(list=clear_list_2)
filterByBoolMask_11 = List.FilterByBoolMask(list=flatten_8, mask=flatten_9)
element_types_4 = ElementTypes("ViewDrafting")
all_elements_of_type_4 = ElementsOfType(element_type=element_types_4)
code_block_43 = CodeBlock { "Keywords"; }
getParameterValueByName_3 = Element.GetParameterValueByName(element=all_elements_of_type_4, parameterName=code_block_43)
containsThisOrThat_3 = dtCore.String.ContainsThisOrThat(str=getParameterValueByName_3, searchFor=flatten_6, lacing=CrossProduct)
anyTrue_5 = Custom[List.AnyTrue](seq=containsThisOrThat_3)
clear_list_3 = Custom[Clear List](input=anyTrue_5)
flatten_10 = List.Flatten(list=clear_list_3)
filterByBoolMask_12 = List.FilterByBoolMask(list=all_elements_of_type_4, mask=flatten_10)
element_types_5 = ElementTypes("ViewSchedule")
all_elements_of_type_5 = ElementsOfType(element_type=element_types_5)
code_block_44 = CodeBlock { "Keywords"; }
getParameterValueByName_4 = Element.GetParameterValueByName(element=all_elements_of_type_5, parameterName=code_block_44)
containsThisOrThat_4 = dtCore.String.ContainsThisOrThat(str=getParameterValueByName_4, searchFor=flatten_6, lacing=CrossProduct)
anyTrue_6 = Custom[List.AnyTrue](seq=containsThisOrThat_4)
clear_list_4 = Custom[Clear List](input=anyTrue_6)
flatten_11 = List.Flatten(list=clear_list_4)
filterByBoolMask_13 = List.FilterByBoolMask(list=all_elements_of_type_5, mask=flatten_11)
element_types_6 = ElementTypes("View3D")
all_elements_of_type_6 = ElementsOfType(element_type=element_types_6)
code_block_45 = CodeBlock { "Keywords"; }
getParameterValueByName_5 = Element.GetParameterValueByName(element=all_elements_of_type_6, parameterName=code_block_45)
containsThisOrThat_5 = dtCore.String.ContainsThisOrThat(str=getParameterValueByName_5, searchFor=flatten_6, lacing=CrossProduct)
anyTrue_7 = Custom[List.AnyTrue](seq=containsThisOrThat_5)
clear_list_5 = Custom[Clear List](input=anyTrue_7)
flatten_12 = List.Flatten(list=clear_list_5)
filterByBoolMask_14 = List.FilterByBoolMask(list=all_elements_of_type_6, mask=flatten_12)
element_types_7 = ElementTypes("ViewPlan")
all_elements_of_type_7 = ElementsOfType(element_type=element_types_7)
code_block_46 = CodeBlock { "Workset"; }
getParameterValueByName_6 = Element.GetParameterValueByName(element=all_elements_of_type_7, parameterName=code_block_46)
nameFromId = WombatDynamo.Workset.NameFromId(id=getParameterValueByName_6)
code_block_47 = CodeBlock { "Template"; }
contains_8 = String.Contains(string=nameFromId, searchFor=code_block_47)
filterByBoolMask_15 = List.FilterByBoolMask(list=all_elements_of_type_7, mask=contains_8)

# group: Remove Levels and Associated Views
code_block_48 = CodeBlock { "Associated Level"; }
getParameterValueByName_7 = Element.GetParameterValueByName(element=filterByBoolMask_15.out, parameterName=code_block_48)
string_from_object_5 = FromObject(object=getParameterValueByName_7)
boolean = BoolSelector(true)
element_types_8 = ElementTypes("ViewSheet")
all_elements_of_type_8 = ElementsOfType(element_type=element_types_8)
code_block_49 = CodeBlock { "Sheet Name"; }
boolean_2 = BoolSelector(true)
element_types_9 = ElementTypes("Level")
all_elements_of_type_9 = ElementsOfType(element_type=element_types_9)
code_block_50 = CodeBlock { "Name"; }
getParameterValueByName_8 = Element.GetParameterValueByName(element=all_elements_of_type_9, parameterName=code_block_50)
string_from_object_6 = FromObject(object=getParameterValueByName_8)
boolean_3 = BoolSelector(true)

# group: Remove Levels and Associated Views > Updated 23_0609
element_types_10 = ElementTypes("ViewSchedule")
all_elements_of_type_10 = ElementsOfType(element_type=element_types_10)
code_block_51 = CodeBlock { "View Name"; }
getParameterValueByName_9 = Element.GetParameterValueByName(element=all_elements_of_type_10, parameterName=code_block_51)
string_from_object_7 = FromObject(object=getParameterValueByName_9)
boolean_4 = BoolSelector(true)
code_block_52 = CodeBlock { "Sheet Series"; }
getParameterValueByName_10 = Element.GetParameterValueByName(element=all_elements_of_type_8, parameterName=code_block_52)
code_block_53 = CodeBlock { "Plans"; }
boolean_5 = BoolSelector(true)

containsThisOrThat_6 = dtCore.String.ContainsThisOrThat(str=string_from_object_7, searchFor=watch, ignoreCase=boolean_4)

# group (continued): Remove Levels and Associated Views > Updated 23_0609
filterByBoolMask_16 = List.FilterByBoolMask(list=all_elements_of_type_10, mask=containsThisOrThat_6)

containsThisOrThat_7 = dtCore.String.ContainsThisOrThat(str=string_from_object_5, searchFor=watch, ignoreCase=boolean)

# group (continued): Remove Levels and Associated Views
filterByBoolMask_17 = List.FilterByBoolMask(list=filterByBoolMask_15.out, mask=containsThisOrThat_7)

containsThisOrThat_8 = dtCore.String.ContainsThisOrThat(str=getParameterValueByName_10, searchFor=code_block_53, ignoreCase=boolean_5)

# group (continued): Remove Levels and Associated Views > Updated 23_0609
filterByBoolMask_18 = List.FilterByBoolMask(list=all_elements_of_type_8, mask=containsThisOrThat_8)

# group (continued): Remove Levels and Associated Views
getParameterValueByName_11 = Element.GetParameterValueByName(element=filterByBoolMask_18.in, parameterName=code_block_49)
string_from_object_8 = FromObject(object=getParameterValueByName_11)

containsThisOrThat_9 = dtCore.String.ContainsThisOrThat(str=string_from_object_8, searchFor=watch, ignoreCase=boolean_2)

# group (continued): Remove Levels and Associated Views
filterByBoolMask_19 = List.FilterByBoolMask(list=filterByBoolMask_18.in, mask=containsThisOrThat_9)

create_8 = List.Create(item0=filterByBoolMask_10.in, item1=filterByBoolMask_11.in, item2=filterByBoolMask_12.in, item3=filterByBoolMask_13.in, item4=filterByBoolMask_14.in, item5=filterByBoolMask_17.in, item6=filterByBoolMask_19.in)
flatten_13 = List.Flatten(list=create_8)
delete_5 = archilab.Revit.Elements.Elements.Delete(element=flatten_13)
containsThisOrThat_10 = dtCore.String.ContainsThisOrThat(str=string_from_object_6, searchFor=watch, ignoreCase=boolean_3)

# group (continued): Remove Levels and Associated Views
filterByBoolMask_20 = List.FilterByBoolMask(list=all_elements_of_type_9, mask=containsThisOrThat_10)

delete_6 = archilab.Revit.Elements.Elements.Delete(element=filterByBoolMask_20.in)
