# Dynamo graph Structural Starter_Project Setup v23_1001_script.dyn "Structural Starter_Project Setup v23_1001" (Dynamo 2.19.3.6394)
# author: Dan Cesarz
# Use this scirpt when starting a Structural project
# packages: Data-Shapes 2022.2.103, Clockwork for Dynamo 2.x 2.4.0, archi-lab.net 2023.213.1523, HGA Usage Tracker 1.0.0, designtech 1.0.8, Genius Loci 2023.2.21

# note: Non CA Sheet Numbers that would be removed.
# note: CA Sheet Numbers that would be removed.

categories = Categories("OST_VolumeOfInterest")  # graph input
all_elements_of_category = ElementsOfCategory(Category=categories)
name = Element.Name(element=all_elements_of_category)
containsThisOrThat = dtCore.String.ContainsThisOrThat(str=name, lacing=CrossProduct)  # unwired: searchFor
anyTrue = Custom[List.AnyTrue](seq=containsThisOrThat)  # package Clockwork for Dynamo 2.x; Returns true if any item in a list of booleans is true.
clear_list = Custom[Clear List](input=anyTrue)  # package archi-lab.net; This node will remove all Null and Empty Lists from any list.
flatten = List.Flatten(list=clear_list)
filterByBoolMask = List.FilterByBoolMask(list=all_elements_of_category, mask=flatten@L1)
hga_usage_tracker = Custom[HGA Usage Tracker]()  # package HGA Usage Tracker; This node tracks usage data relevant to HGA's Digital Practice Group. For questions regarding this data please reach out to the DPG.
code_block = CodeBlock { "Starting View"; }
sheet_byname = Custom[Sheet ByName](NameOrNumber=code_block)  # package Genius Loci; Collects sheets by name or number in the active or given document.
code_block_2 = CodeBlock { "HGA Production Setup"; }
file_path = Filename("..\Shared Files\HGA_ClassicLogo_Bug_.png")
fromPath = FileObject(path=file_path)  # "File.FromPath"
readFromFile = Image.ReadFromFile(file=fromPath)
code_block_3 = CodeBlock { "Run Setup"; }
code_block_4 = CodeBlock { "Is this project confidential?:"; true; "Check box for Yes(or possibly)/Leave unchecked for No"; }
boolean_input = Custom[Boolean input](InputName=code_block_4.out0, DefaultValue=code_block_4.out1, SideText=code_block_4.out2)  # package Data-Shapes; Creates a boolean input for UI.MultipleInputForm ++ . Check out www.data-shapes.net for more infos!
code_block_5 = CodeBlock { false; }
code_block_6 = CodeBlock { "Will the project require overall / area plans?:"; true; "Check box for Yes(or possibly)/Leave unchecked for No"; }
boolean_input_2 = Custom[Boolean input](InputName=code_block_6.out0, DefaultValue=code_block_6.out1, SideText=code_block_6.out2)
code_block_7 = CodeBlock { "Check to Remove:"; false; "Demolition Content"; }
boolean_input_3 = Custom[Boolean input](InputName=code_block_7.out0, DefaultValue=code_block_7.out1, SideText=code_block_7.out2)
code_block_8 = CodeBlock { "Check to Remove:"; false; "Existing Content"; }
boolean_input_4 = Custom[Boolean input](InputName=code_block_8.out0, DefaultValue=code_block_8.out1, SideText=code_block_8.out2)
code_block_9 = CodeBlock { "Check to Remove:"; false; "California Content"; }
code_block_10 = CodeBlock { "Check Project Styles to Remove:"; }
code_block_11 = CodeBlock()
# ---------- code_block_11.designscript (22 lines) ----------
"Braced Frames";
"Composite Deck";
"Cast-in-Place Concrete";
"Precast Concrete";
"Post Tensioned Concrete";
"CMU (catch-all for masonry)";
"Elevated Cast in Place Concrete";
"Concrete Repair, Reinforcing or Retrofit";
"Drilled Piers";
"Fabricator-Designed Connections (Steel)";
"Light Gauge Steel (cold formed)";
"Medical Equipment Supports";
"Moment Frames";
"Driven Piles";
"Pan and Joist";
"Parking Ramp";
"Roof Deck";
"Steel Joists";
"Steel Framing (051200)";
"Trusses";
"Tilt-up";
"Wood";
# ----------------------------------------
create = List.Create(item0=code_block_11.out0, item1=code_block_11.out1, item2=code_block_11.out2, item3=code_block_11.out3, item4=code_block_11.out4, item5=code_block_11.out5, item6=code_block_11.out6, item7=code_block_11.out7, item8=code_block_11.out8, item9=code_block_11.out9, item10=code_block_11.out10, item11=code_block_11.out11, item12=code_block_11.out12, item13=code_block_11.out13, item14=code_block_11.out14, item15=code_block_11.out15, item16=code_block_11.out16, item17=code_block_11.out17, item18=code_block_11.out18, item19=code_block_11.out19, item20=code_block_11.out20, item21=code_block_11.out21)
code_block_12 = CodeBlock()
# ---------- code_block_12.designscript (22 lines) ----------
"BF";
"CD";
"CIP";
"PC";
"PT";
"CMU";
"Conc";
"CR";
"DP";
"FDC";
"LG";
"MEQS";
"MF";
"Piles";
"PJ";
"PR";
"RD";
"SJ";
"Steel";
"Truss";
"TU";
"WD";
# ----------------------------------------
create_2 = List.Create(item0=code_block_12.out0, item1=code_block_12.out1, item2=code_block_12.out2, item3=code_block_12.out3, item4=code_block_12.out4, item5=code_block_12.out5, item6=code_block_12.out6, item7=code_block_12.out7, item8=code_block_12.out8, item9=code_block_12.out9, item10=code_block_12.out10, item11=code_block_12.out11, item12=code_block_12.out12, item13=code_block_12.out13, item14=code_block_12.out14, item15=code_block_12.out15, item16=code_block_12.out16, item17=code_block_12.out17, item18=code_block_12.out18, item19=code_block_12.out19, item20=code_block_12.out20, item21=code_block_12.out21)
code_block_13 = CodeBlock { false; }
listview_data = Custom[Listview Data](InputName=code_block_10, Keys=create, Values=create_2, SortItems_optionnal=code_block_13)  # package Data-Shapes; Create data for ListView input in UI.MultiInputForm ++ . Check out www.data-shapes.net for more infos.
code_block_14 = CodeBlock { true; }
code_block_15 = CodeBlock { "Cancel"; 800; 800; }

# group: Add back in if multiple levels are added
code_block_16 = CodeBlock()
# ---------- code_block_16.designscript (2 lines) ----------
"Check Levels to Remove:";
["Foundation","Level 01","Level 02","Level 03","Level 04","Level 05", "Level 06", "Level 07", "Level 08", "ROOF"];
# ----------------------------------------
code_block_17 = CodeBlock { false; }
listview_data_2 = Custom[Listview Data](InputName=code_block_16.out0, Keys=code_block_16.out1, Values=code_block_16.out1, SortItems_optionnal=code_block_17)

code_block_18 = CodeBlock { "Confidential Project"; }
element_types = ElementTypes("Family")
all_elements_of_type = ElementsOfType(element_type=element_types)
code_block_19 = CodeBlock { "Keywords"; }
getParameterValueByName = Element.GetParameterValueByName(element=all_elements_of_type, parameterName=code_block_19)
code_block_20 = CodeBlock { true; }
code_block_21 = CodeBlock { "Demo"; "None"; }
code_block_22 = CodeBlock { true; }
code_block_23 = CodeBlock { "EXG"; "None"; }
code_block_24 = CodeBlock { true; }

# group: Confirm Output
# note: CA Sheet Numbers that would be removed.
# note: Non CA Sheet Numbers that would be removed.
code_block_25 = CodeBlock()
# ---------- code_block_25.designscript (3 lines) ----------
"Check Levels to Remove:";
["Foundation","Level 01","Level 02","Level 03","Level 04","Level 05", "Level 06", "Level 07", "Level 08","Roof"];
[0, 1, 2, 3, 4, 5, 6, 7, 8, 9];
# ----------------------------------------
boolean_input_5 = Custom[Boolean input](InputName=code_block_9.out0, DefaultValue=code_block_9.out1, SideText=code_block_9.out2)

listview_data_3 = Custom[Listview Data](InputName=code_block_25.out0, Keys=code_block_25.out1, Values=code_block_25.out2, SortItems_optionnal=code_block_5)
create_3 = List.Create(item0=boolean_input, item1=listview_data_3, item2=boolean_input_2, item3=boolean_input_3, item4=boolean_input_4, item5=boolean_input_5, item6=listview_data)
multipleinputform = Custom[MultipleInputForm ++](Description_optional=code_block_2, Logo_optional=readFromFile, ButtonText_optional=code_block_3, Inputs=create_3, Toggle=code_block_14, CancelButtonText_optional=code_block_15.out0, MaxHeight_optional=code_block_15.out1, Width_optional=code_block_15.out2)  # package Data-Shapes; Create a form with multiple inputs. see www.data-shapes.net for tutorials and infos!

# group: Script Run Data for Starter
code_block_26 = CodeBlock { "Script Revit Version"; "Script Run Date"; }
version = Custom[Application.Version]()  # package Clockwork for Dynamo 2.x; Retrieves the name, version and build of the current Revit application.
string_from_object = FromObject(obj=version.Build)
setParameterByName = Element.SetParameterByName(element=sheet_byname, parameterName=code_block_26.out0, value=string_from_object)
today = DateTime.Today()
string_from_object_2 = FromObject(obj=today)
code_block_27 = CodeBlock { " "; true; }
code_block_28 = CodeBlock { "/"; }
code_block_29 = CodeBlock { 2; 0; 1; }
code_block_30 = CodeBlock { "."; }
code_block_31 = CodeBlock { "Save Here - HGA"; }
byFamilyNameAndTypeName = FamilyType.ByFamilyNameAndTypeName(familyName=code_block_31, typeName=code_block_31)
all_elements_of_family_type = ElementsOfFamilyType(Family_Type=byFamilyNameAndTypeName)
code_block_32 = CodeBlock { "Script Was Run Visibility"; }
setParameterByName_2 = Element.SetParameterByName(element=all_elements_of_family_type, parameterName=code_block_32, value=multipleinputform.Was_Run)

removeAfterCharacters = dtCore.String.RemoveAfterCharacters(str=string_from_object_2, characters=code_block_27.out0, includeChar=code_block_27.out1)

# group (continued): Script Run Data for Starter
split = String.Split(string=removeAfterCharacters, separator0=code_block_28)
getItemAtIndex = List.GetItemAtIndex(list=split, index=code_block_29.out0)
getItemAtIndex_2 = List.GetItemAtIndex(list=split, index=code_block_29.out1)
getItemAtIndex_3 = List.GetItemAtIndex(list=split, index=code_block_29.out2)
concat = String.Concat(string0=getItemAtIndex, string1=code_block_30, string2=getItemAtIndex_2, string3=code_block_30, string4=getItemAtIndex_3)
setParameterByName_3 = Element.SetParameterByName(element=setParameterByName, parameterName=code_block_26.out1, value=concat)

code_block_33 = CodeBlock(confidential=multipleinputform.User_Inputs, levelstoremove=multipleinputform.User_Inputs, overallplans=multipleinputform.User_Inputs, removedemo=multipleinputform.User_Inputs, removeexisting=multipleinputform.User_Inputs, removecalifornia=multipleinputform.User_Inputs, removebykeyword=multipleinputform.User_Inputs)
# ---------- code_block_33.designscript (7 lines) ----------
confidential[0];
levelstoremove[1];
overallplans[2];
removedemo[3];
removeexisting[4];
removecalifornia[5];
removebykeyword[6];
# ----------------------------------------

# group: Overall and 1/8" Floor Plans
categories_2 = Categories("OST_Sheets")
all_elements_of_category_2 = ElementsOfCategory(Category=categories_2)
sheetNumber = Sheet.SheetNumber(sheet=all_elements_of_category_2)
code_block_34 = CodeBlock { "ROADBLOCK"; ".X"; }
contains = String.Contains(string=sheetNumber, searchFor=code_block_34.out1)
filterByBoolMask_2 = List.FilterByBoolMask(list=all_elements_of_category_2, mask=contains)
code_block_35 = CodeBlock { "Sheet Number"; }
sheetNumber_2 = Sheet.SheetNumber(sheet=filterByBoolMask_2.in)
length = String.Length(string=sheetNumber_2)
code_block_36 = CodeBlock { 2; }
sub = length - code_block_36
remove = String.Remove(string=sheetNumber_2, startIndex=sub, count=code_block_36)
code_block_37 = CodeBlock { ".Y"; "ROADBLOCK"; }
if_ = RefactoredIf(test=code_block_33.out2, true=code_block_37.out0, false=code_block_37.out1)
contains_2 = String.Contains(string=sheetNumber, searchFor=if_)
filterByBoolMask_3 = List.FilterByBoolMask(list=all_elements_of_category_2, mask=contains_2)
flatten_2 = List.Flatten(list=filterByBoolMask_3.in)
delete = Element.Delete(element=flatten_2)
passthrough = Custom[Passthrough](passThrough=remove, waitFor=delete)  # package Clockwork for Dynamo 2.x; Forces a sequential order of execution. The node wired into the output of the Passthrough node will be executed *after* the node wired into the waitFor input (e.g. important for some Revit operations). The value of the passThrough input will be passed on to the node wired into the output port of the Passthrough node.
setParameterByName_4 = Element.SetParameterByName(element=filterByBoolMask_2.in, parameterName=code_block_35, value=passthrough)
contains_3 = String.Contains(string=sheetNumber, searchFor=code_block_37.out0)
filterByBoolMask_4 = List.FilterByBoolMask(list=all_elements_of_category_2, mask=contains_3)
sheetNumber_3 = Sheet.SheetNumber(sheet=filterByBoolMask_4.in)
length_2 = String.Length(string=sheetNumber_3)
code_block_38 = CodeBlock { 2; }
sub_2 = length_2 - code_block_38
remove_2 = String.Remove(string=sheetNumber_3, startIndex=sub_2, count=code_block_38)
if_2 = RefactoredIf(test=code_block_33.out2, true=code_block_34.out0, false=code_block_34.out1)
contains_4 = String.Contains(string=sheetNumber, searchFor=if_2)
filterByBoolMask_5 = List.FilterByBoolMask(list=all_elements_of_category_2, mask=contains_4)
views = Sheet.Views(sheet=filterByBoolMask_5.in)
type = Object.Type(object=views)
code_block_39 = CodeBlock { "Plan"; }
contains_5 = String.Contains(string=type, searchFor=code_block_39)
filterByBoolMask_6 = List.FilterByBoolMask(list=views, mask=contains_5)
flatten_3 = List.Flatten(list=filterByBoolMask_6.in)
list_create = List.Create(item0=filterByBoolMask_5.in, item1=flatten_3)
flatten_4 = List.Flatten(list=list_create)
delete_2 = Element.Delete(element=flatten_4)
passthrough_2 = Custom[Passthrough](passThrough=remove_2, waitFor=delete_2)
setParameterByName_5 = Element.SetParameterByName(element=filterByBoolMask_4.in, parameterName=code_block_35, value=passthrough_2)

setParameterByName_6 = Element.SetParameterByName(element=all_elements_of_family_type, parameterName=code_block_18, value=code_block_33.out0)
eq = code_block_33.out3 == code_block_20
if_3 = If(test=eq, true=code_block_21.out0, false=code_block_21.out1)
eq_2 = code_block_33.out4 == code_block_22
if_4 = If(test=eq_2, true=code_block_23.out0, false=code_block_23.out1)

# group (continued): Confirm Output
eq_3 = code_block_33.out5 == code_block_24

code_block_40 = CodeBlock { "CA"; "None"; }
if_5 = If(test=eq_3, true=code_block_40.out0, false=code_block_40.out1)
list_create_2 = List.Create(item0=if_3, item1=if_4, item2=if_5, item3=code_block_33.out6)
flatten_5 = List.Flatten(list=list_create_2)
containsThisOrThat_2 = dtCore.String.ContainsThisOrThat(str=getParameterValueByName, searchFor=flatten_5, lacing=CrossProduct)
anyTrue_2 = Custom[List.AnyTrue](seq=containsThisOrThat_2)
clear_list_2 = Custom[Clear List](input=anyTrue_2)
flatten_6 = List.Flatten(list=clear_list_2)
filterByBoolMask_7 = List.FilterByBoolMask(list=all_elements_of_type, mask=flatten_6)
element_types_2 = ElementTypes("ViewSheet")
all_elements_of_type_2 = ElementsOfType(element_type=element_types_2)
element_types_3 = ElementTypes("ViewPlan")
all_elements_of_type_3 = ElementsOfType(element_type=element_types_3)
create_4 = List.Create(item0=all_elements_of_type_2, item1=all_elements_of_type_3)
flatten_7 = List.Flatten(list=create_4)
code_block_41 = CodeBlock { "Keywords"; }
getParameterValueByName_2 = Element.GetParameterValueByName(element=flatten_7, parameterName=code_block_41)
containsThisOrThat_3 = dtCore.String.ContainsThisOrThat(str=getParameterValueByName_2, searchFor=flatten_5, lacing=CrossProduct)
anyTrue_3 = Custom[List.AnyTrue](seq=containsThisOrThat_3)
clear_list_3 = Custom[Clear List](input=anyTrue_3)
flatten_8 = List.Flatten(list=clear_list_3)
filterByBoolMask_8 = List.FilterByBoolMask(list=flatten_7, mask=flatten_8)
element_types_4 = ElementTypes("ViewDrafting")
all_elements_of_type_4 = ElementsOfType(element_type=element_types_4)
code_block_42 = CodeBlock { "Keywords"; }
getParameterValueByName_3 = Element.GetParameterValueByName(element=all_elements_of_type_4, parameterName=code_block_42)
containsThisOrThat_4 = dtCore.String.ContainsThisOrThat(str=getParameterValueByName_3, searchFor=flatten_5, lacing=CrossProduct)
anyTrue_4 = Custom[List.AnyTrue](seq=containsThisOrThat_4)
clear_list_4 = Custom[Clear List](input=anyTrue_4)
flatten_9 = List.Flatten(list=clear_list_4)
filterByBoolMask_9 = List.FilterByBoolMask(list=all_elements_of_type_4, mask=flatten_9)
create_5 = List.Create(item0=filterByBoolMask_7.in, item1=filterByBoolMask_8.in, item2=filterByBoolMask_9.in)
flatten_10 = List.Flatten(list=create_5)
delete_3 = archilab.Revit.Elements.Elements.Delete(element=flatten_10)
categories_3 = Categories("OST_Sheets")
all_elements_of_category_3 = ElementsOfCategory(Category=categories_3)
sheetNumber_4 = Sheet.SheetNumber(sheet=all_elements_of_category_3)
getNumber = String.GetNumber(string=sheetNumber_4)
toNumber = String.ToNumber(string=getNumber)
isNull = Object.IsNull(object=toNumber)
filterByBoolMask_10 = List.FilterByBoolMask(list=all_elements_of_category_3, mask=isNull)
filterByBoolMask_11 = List.FilterByBoolMask(list=toNumber, mask=isNull)
code_block_43 = CodeBlock { 300; 99; }
lt = filterByBoolMask_11.out < code_block_43.out0
gt = filterByBoolMask_11.out > code_block_43.out1
and_ = And(bool0=lt, bool1=gt)
filterByBoolMask_12 = List.FilterByBoolMask(list=filterByBoolMask_10.out, mask=and_)
sheetNumber_5 = Sheet.SheetNumber(sheet=filterByBoolMask_12.out)
getNumber_2 = String.GetNumber(string=sheetNumber_5)
toNumber_2 = String.ToNumber(string=getNumber_2)
countOccurences = Custom[List.CountOccurences](seq=toNumber_2)  # package Clockwork for Dynamo 2.x; Counts the number of occurences of each unique element in a given list
code_block_44 = CodeBlock { 1; }
gt_2 = countOccurences.count > code_block_44
code_block_45 = CodeBlock { true; }
allIndicesOf = List.AllIndicesOf(list=gt_2, item=code_block_45)
getItemAtIndex_4 = List.GetItemAtIndex(list=countOccurences.uniqueElements, index=allIndicesOf)
allIndicesOf_2 = List.AllIndicesOf(list=toNumber_2, item=getItemAtIndex_4)
getItemAtIndex_5 = List.GetItemAtIndex(list=filterByBoolMask_12.out, index=allIndicesOf_2)
getItemAtIndex_6 = List.GetItemAtIndex(list=sheetNumber_5, index=allIndicesOf_2)

# group: 24_0429
sortByKey = List.SortByKey(list=getItemAtIndex_5@L2, keys=getItemAtIndex_6@L2)

transpose = List.Transpose(lists=sortByKey.sortedList@L3)
code_block_46 = CodeBlock { 0; 1; }
getItemAtIndex_7 = List.GetItemAtIndex(list=transpose@L3, index=code_block_46.out1)
getItemAtIndex_8 = List.GetItemAtIndex(list=transpose@L3, index=code_block_46.out0)
if_6 = RefactoredIf(test=eq_3, true=getItemAtIndex_7, false=getItemAtIndex_8)
delete_4 = Element.Delete(element=if_6)
code_block_47 = CodeBlock()  # //remove CA sheets if set to true
transpose_2 = List.Transpose(lists=sortByKey.sortedKeys@L3)
getItemAtIndex_9 = List.GetItemAtIndex(list=transpose_2@L3, index=code_block_46.out0)
getItemAtIndex_10 = List.GetItemAtIndex(list=transpose_2@L3, index=code_block_46.out1)

# group: CA Sheet Numbers that would be removed.
sheetNumber_6 = Sheet.SheetNumber(sheet=getItemAtIndex_7)

flatten_11 = List.Flatten(list=sheetNumber_6)
code_block_48 = CodeBlock { "."; true; }
removeAfterCharacters_2 = dtCore.String.RemoveAfterCharacters(str=flatten_11, characters=code_block_48.out0, ignoreCase=code_block_48.out1, includeChar=code_block_48.out1)
if_7 = RefactoredIf(test=eq_3, true=getItemAtIndex_8, false=getItemAtIndex_7)
sheetNumber_7 = Sheet.SheetNumber(sheet=filterByBoolMask_8.in)
sheetNumber_8 = Sheet.SheetNumber(sheet=if_6)

# group: 23_0927
categories_4 = Categories("OST_Sheets")
all_elements_of_category_4 = ElementsOfCategory(Category=categories_4)
code_block_49 = CodeBlock { "FOUNDATION"; "LEVEL 01"; "LEVEL 02"; "LEVEL 03"; "LEVEL 04"; "LEVEL 05"; "LEVEL 06"; "LEVEL 07"; "LEVEL 08"; "ROOF"; }
list_create_3 = List.Create(item0=code_block_49.out0, item1=code_block_49.out1, item2=code_block_49.out2, item3=code_block_49.out3, item4=code_block_49.out4, item5=code_block_49.out5, item6=code_block_49.out6, item7=code_block_49.out7, item8=code_block_49.out8, item9=code_block_49.out9)
getItemAtIndex_11 = List.GetItemAtIndex(list=list_create_3, index=code_block_33.out1)
code_block_50 = CodeBlock { true; }

# group: 23_0927 > 24_0328
# foundation level remove was purging detail sheets with "foundation" in name still needed in projects with a level 1
sheetNumber_9 = Sheet.SheetNumber(sheet=all_elements_of_category_4)
getNumber_3 = String.GetNumber(string=sheetNumber_9)
toNumber_3 = String.ToNumber(string=getNumber_3)
code_block_51 = CodeBlock { 500; }
ge = toNumber_3 >= code_block_51
code_block_52 = CodeBlock { true; }
replaceNull = Custom[List.ReplaceNull](seq=ge, replacement=code_block_52)  # package Clockwork for Dynamo 2.x; Replaces all null values within a given list with a substitute
filterByBoolMask_13 = List.FilterByBoolMask(list=all_elements_of_category_4, mask=replaceNull)

# group (continued): 23_0927
sheetName = Sheet.SheetName(sheet=filterByBoolMask_13.out)
contains_6 = String.Contains(string=sheetName, searchFor=getItemAtIndex_11, ignoreCase=code_block_50, lacing=CrossProduct)
anyTrue_5 = List.AnyTrue(list=contains_6@L2)
filterByBoolMask_14 = List.FilterByBoolMask(list=filterByBoolMask_13.out, mask=anyTrue_5)
passthrough_3 = Custom[Passthrough](passThrough=filterByBoolMask_14.in, waitFor=delete_2)
sheetNumber_10 = Sheet.SheetNumber(sheet=passthrough_3)
delete_5 = archilab.Revit.Elements.Elements.Delete(element=passthrough_3)

element_types_5 = ElementTypes("ViewPlan")
all_elements_of_type_5 = ElementsOfType(element_class=element_types_5)
flatten_12 = List.Flatten(list=all_elements_of_type_5)
code_block_53 = CodeBlock { "View Name"; }
getParameterValueByName_4 = Element.GetParameterValueByName(element=flatten_12, parameterName=code_block_53)
code_block_54 = CodeBlock { true; }
containsThisOrThat_5 = dtCore.String.ContainsThisOrThat(str=getParameterValueByName_4, searchFor=getItemAtIndex_11, ignoreCase=code_block_54, lacing=CrossProduct)
anyTrue_6 = Custom[List.AnyTrue](seq=containsThisOrThat_5)
clear_list_5 = Custom[Clear List](input=anyTrue_6)
flatten_13 = List.Flatten(list=clear_list_5)
filterByBoolMask_15 = List.FilterByBoolMask(list=flatten_12, mask=flatten_13)
passthrough_4 = Custom[Passthrough](passThrough=filterByBoolMask_15.in, waitFor=delete_5)
delete_6 = archilab.Revit.Elements.Elements.Delete(element=passthrough_4)
