# Dynamo graph Technology_Starter_Project Setup v23_0401_script.dyn "Technology_Starter_Project Setup v23_0401" (Dynamo 2.19.3.6394)
# author: HGA DPG
# Use this script when starting a Technology project.
# packages: Data-Shapes 2022.2.103, designtech 1.0.8, archi-lab.net 2023.213.1523, Clockwork for Dynamo 2.x 2.4.0, HGA Usage Tracker 1.0.0, WombatDynamo 2.3.5, Genius Loci 2023.2.21

element_types = ElementTypes("Family")
all_elements_of_type = ElementsOfType(element_type=element_types)
code_block = CodeBlock { "Keywords"; }
getParameterValueByName = Element.GetParameterValueByName(element=all_elements_of_type, parameterName=code_block)
code_block_2 = CodeBlock { "HGA Production Setup"; }
file_path = Filename("..\Shared Files\HGA_ClassicLogo_Bug_.png")
fromPath = FileObject(path=file_path)  # "File.FromPath"
readFromFile = Image.ReadFromFile(file=fromPath)
code_block_3 = CodeBlock { "Run Setup"; }
code_block_4 = CodeBlock { "Is this project confidential?:"; true; "Check box for Yes(or possibly)/Leave unchecked for No"; }
UI_TextSplitter = Custom[UI_TextSplitter](str=code_block_4.out0)  # package HGA Usage Tracker; This node will split a single string of text as necessary to input into data shapes so that text doesn't overlap lists, dropdowns, etc.
ui_boolean_input = Custom[UI.Boolean input](InputName=UI_TextSplitter, DefaultValue=code_block_4.out1, SideText=code_block_4.out2)  # package Data-Shapes; Creates a boolean input for UI.MultipleInputForm ++ . Check out www.data-shapes.net for more infos!

# group: Add back in if multiple levels are added
code_block_5 = CodeBlock()
# ---------- code_block_5.designscript (2 lines) ----------
"Check Levels to Remove:";
["Lower Level","Level 01","Level 02","Level 03","Level 04","Level 05", "Level 06", "Level 07", "Level 08", "ROOF"];
# ----------------------------------------
UI_TextSplitter_2 = Custom[UI_TextSplitter](str=code_block_5.out0)
code_block_6 = CodeBlock { false; }
ui_listview_data = Custom[UI.Listview Data](InputName=UI_TextSplitter_2, Keys=code_block_5.out1, Values=code_block_5.out1, SortItems_optionnal=code_block_6)  # package Data-Shapes; Create data for ListView input in UI.MultiInputForm ++ . Check out www.data-shapes.net for more infos.

code_block_7 = CodeBlock { "Will the project require overall / area plans?:"; true; "Check box for Yes(or possibly)/Leave unchecked for No"; }
UI_TextSplitter_3 = Custom[UI_TextSplitter](str=code_block_7.out0)
ui_boolean_input_2 = Custom[UI.Boolean input](InputName=UI_TextSplitter_3, DefaultValue=code_block_7.out1, SideText=code_block_7.out2)
code_block_8 = CodeBlock { "Check to Remove:"; }
UI_TextSplitter_4 = Custom[UI_TextSplitter](str=code_block_8)
code_block_9 = CodeBlock { "Details"; "Schedules"; "Sheets"; }
create = List.Create(item0=code_block_9.out0, item1=code_block_9.out1, item2=code_block_9.out2)
code_block_10 = CodeBlock { "Detail"; "Schedule"; "Sheet"; }
create_2 = List.Create(item0=code_block_10.out0, item1=code_block_10.out1, item2=code_block_10.out2)
code_block_11 = CodeBlock { false; }
ui_listview_data_2 = Custom[UI.Listview Data](InputName=UI_TextSplitter_4, Keys=create, Values=create_2, SortItems_optionnal=code_block_11)
code_block_12 = CodeBlock { "Check to Remove:"; }
UI_TextSplitter_5 = Custom[UI_TextSplitter](str=code_block_12)
code_block_13 = CodeBlock()
# ---------- code_block_13.designscript (8 lines) ----------
"Demo Content";
"Audiovisual Content";
"Audiovisual Sound Masking Content";
"Nurse Call Content";
"Public Address Content";
"Security Content";
"Technology Content";
"Seismic Content";
# ----------------------------------------
create_3 = List.Create(item0=code_block_13.out0, item1=code_block_13.out1, item2=code_block_13.out2, item3=code_block_13.out3, item4=code_block_13.out4, item5=code_block_13.out5, item6=code_block_13.out6, item7=code_block_13.out7)
code_block_14 = CodeBlock { "Demo"; "AV"; "AVSM"; "NC"; "PA"; "SC"; "TN"; "SZ"; }
create_4 = List.Create(item0=code_block_14.out0, item1=code_block_14.out1, item2=code_block_14.out2, item3=code_block_14.out3, item4=code_block_14.out4, item5=code_block_14.out5, item6=code_block_14.out6, item7=code_block_14.out7)
ui_listview_data_3 = Custom[UI.Listview Data](InputName=UI_TextSplitter_5, Keys=create_3, Values=create_4, SortItems_optionnal=code_block_11)
create_5 = List.Create(item0=ui_boolean_input, item1=ui_listview_data, item2=ui_boolean_input_2, item3=ui_listview_data_2, item4=ui_listview_data_3)
code_block_15 = CodeBlock { true; }
code_block_16 = CodeBlock { "Cancel"; }
ui_multipleinputform = Custom[UI.MultipleInputForm ++](Description_optional=code_block_2, Logo_optional=readFromFile, ButtonText_optional=code_block_3, Inputs=create_5, Toggle=code_block_15, CancelButtonText_optional=code_block_16)  # package Data-Shapes; Create a form with multiple inputs. see www.data-shapes.net for tutorials and infos!
code_block_17 = CodeBlock(confidential=ui_multipleinputform.User_Inputs, removelevels=ui_multipleinputform.User_Inputs, areaplans=ui_multipleinputform.User_Inputs, removedss=ui_multipleinputform.User_Inputs, removebykeyword=ui_multipleinputform.User_Inputs) { confidential[0]; removelevels[1]; areaplans[2]; removedss[3]; removebykeyword[4]; }
create_6 = List.Create(item0=code_block_17.out3, item1=code_block_17.out4)
flatten = List.Flatten(list=create_6)
containsThisOrThat = dtCore.String.ContainsThisOrThat(str=getParameterValueByName, searchFor=flatten, lacing=CrossProduct)
anyTrue = Custom[List.AnyTrue](seq=containsThisOrThat)  # package Clockwork for Dynamo 2.x; Returns true if any item in a list of booleans is true.
clear_list = Custom[Clear List](input=anyTrue)  # package archi-lab.net; This node will remove all Null and Empty Lists from any list.
flatten_2 = List.Flatten(list=clear_list)
filterByBoolMask = List.FilterByBoolMask(list=all_elements_of_type, mask=flatten_2)
element_types_2 = ElementTypes("ViewSheet")
all_elements_of_type_2 = ElementsOfType(element_type=element_types_2)
element_types_3 = ElementTypes("ViewPlan")
all_elements_of_type_3 = ElementsOfType(element_type=element_types_3)
create_7 = List.Create(item0=all_elements_of_type_2, item1=all_elements_of_type_3)
flatten_3 = List.Flatten(list=create_7)
code_block_18 = CodeBlock { "Keywords"; }
getParameterValueByName_2 = Element.GetParameterValueByName(element=flatten_3, parameterName=code_block_18)
containsThisOrThat_2 = dtCore.String.ContainsThisOrThat(str=getParameterValueByName_2, searchFor=flatten, lacing=CrossProduct)
anyTrue_2 = Custom[List.AnyTrue](seq=containsThisOrThat_2)
clear_list_2 = Custom[Clear List](input=anyTrue_2)
flatten_4 = List.Flatten(list=clear_list_2)
filterByBoolMask_2 = List.FilterByBoolMask(list=flatten_3, mask=flatten_4)
element_types_4 = ElementTypes("ViewDrafting")
all_elements_of_type_4 = ElementsOfType(element_type=element_types_4)
code_block_19 = CodeBlock { "Keywords"; }
getParameterValueByName_3 = Element.GetParameterValueByName(element=all_elements_of_type_4, parameterName=code_block_19)
containsThisOrThat_3 = dtCore.String.ContainsThisOrThat(str=getParameterValueByName_3, searchFor=flatten, lacing=CrossProduct)
anyTrue_3 = Custom[List.AnyTrue](seq=containsThisOrThat_3)
clear_list_3 = Custom[Clear List](input=anyTrue_3)
flatten_5 = List.Flatten(list=clear_list_3)
filterByBoolMask_3 = List.FilterByBoolMask(list=all_elements_of_type_4, mask=flatten_5)
element_types_5 = ElementTypes("ViewSchedule")
all_elements_of_type_5 = ElementsOfType(element_type=element_types_5)
code_block_20 = CodeBlock { "Keywords"; }
getParameterValueByName_4 = Element.GetParameterValueByName(element=all_elements_of_type_5, parameterName=code_block_20)
containsThisOrThat_4 = dtCore.String.ContainsThisOrThat(str=getParameterValueByName_4, searchFor=flatten, lacing=CrossProduct)
anyTrue_4 = Custom[List.AnyTrue](seq=containsThisOrThat_4)
clear_list_4 = Custom[Clear List](input=anyTrue_4)
flatten_6 = List.Flatten(list=clear_list_4)
filterByBoolMask_4 = List.FilterByBoolMask(list=all_elements_of_type_5, mask=flatten_6)
element_types_6 = ElementTypes("View3D")
all_elements_of_type_6 = ElementsOfType(element_type=element_types_6)
code_block_21 = CodeBlock { "Keywords"; }
getParameterValueByName_5 = Element.GetParameterValueByName(element=all_elements_of_type_6, parameterName=code_block_21)
containsThisOrThat_5 = dtCore.String.ContainsThisOrThat(str=getParameterValueByName_5, searchFor=flatten, lacing=CrossProduct)
anyTrue_5 = Custom[List.AnyTrue](seq=containsThisOrThat_5)
clear_list_5 = Custom[Clear List](input=anyTrue_5)
flatten_7 = List.Flatten(list=clear_list_5)
filterByBoolMask_5 = List.FilterByBoolMask(list=all_elements_of_type_6, mask=flatten_7)
element_types_7 = ElementTypes("ViewPlan")
all_elements_of_type_7 = ElementsOfType(element_type=element_types_7)
code_block_22 = CodeBlock { "Workset"; }
getParameterValueByName_6 = Element.GetParameterValueByName(element=all_elements_of_type_7, parameterName=code_block_22)
nameFromId = WombatDynamo.Workset.NameFromId(id=getParameterValueByName_6)
code_block_23 = CodeBlock { "Template"; }
contains = String.Contains(string=nameFromId, searchFor=code_block_23)
filterByBoolMask_6 = List.FilterByBoolMask(list=all_elements_of_type_7, mask=contains)

# group: Remove Levels and Associated Views
code_block_24 = CodeBlock { "Associated Level"; }
getParameterValueByName_7 = Element.GetParameterValueByName(element=filterByBoolMask_6.out, parameterName=code_block_24)
string_from_object = FromObject(object=getParameterValueByName_7)
boolean = BoolSelector(true)
element_types_8 = ElementTypes("ViewSheet")
all_elements_of_type_8 = ElementsOfType(element_type=element_types_8)
code_block_25 = CodeBlock { "Sheet Name"; }
getParameterValueByName_8 = Element.GetParameterValueByName(element=all_elements_of_type_8, parameterName=code_block_25)
string_from_object_2 = FromObject(object=getParameterValueByName_8)
boolean_2 = BoolSelector(true)
element_types_9 = ElementTypes("ViewSchedule")
all_elements_of_type_9 = ElementsOfType(element_type=element_types_9)
code_block_26 = CodeBlock { "View Name"; }
getParameterValueByName_9 = Element.GetParameterValueByName(element=all_elements_of_type_9, parameterName=code_block_26)
string_from_object_3 = FromObject(object=getParameterValueByName_9)
boolean_3 = BoolSelector(true)
element_types_10 = ElementTypes("Level")
all_elements_of_type_10 = ElementsOfType(element_type=element_types_10)
code_block_27 = CodeBlock { "Name"; }
getParameterValueByName_10 = Element.GetParameterValueByName(element=all_elements_of_type_10, parameterName=code_block_27)
string_from_object_4 = FromObject(object=getParameterValueByName_10)
boolean_4 = BoolSelector(true)

watch = Watch(code_block_17.out1)
containsThisOrThat_6 = dtCore.String.ContainsThisOrThat(str=string_from_object, searchFor=watch, ignoreCase=boolean)

# group (continued): Remove Levels and Associated Views
filterByBoolMask_7 = List.FilterByBoolMask(list=filterByBoolMask_6.out, mask=containsThisOrThat_6)

containsThisOrThat_7 = dtCore.String.ContainsThisOrThat(str=string_from_object_2, searchFor=watch, ignoreCase=boolean_2)

# group (continued): Remove Levels and Associated Views
filterByBoolMask_8 = List.FilterByBoolMask(list=all_elements_of_type_8, mask=containsThisOrThat_7)

containsThisOrThat_8 = dtCore.String.ContainsThisOrThat(str=string_from_object_3, searchFor=watch, ignoreCase=boolean_3)

# group (continued): Remove Levels and Associated Views
filterByBoolMask_9 = List.FilterByBoolMask(list=all_elements_of_type_9, mask=containsThisOrThat_8)

create_8 = List.Create(item0=filterByBoolMask.in, item1=filterByBoolMask_2.in, item2=filterByBoolMask_3.in, item3=filterByBoolMask_4.in, item4=filterByBoolMask_5.in, item5=filterByBoolMask_7.in, item6=filterByBoolMask_8.in, item7=filterByBoolMask_9.in)
flatten_8 = List.Flatten(list=create_8)
delete = archilab.Revit.Elements.Elements.Delete(element=flatten_8)
hga_usage_tracker = Custom[HGA Usage Tracker]()  # package HGA Usage Tracker; This node tracks usage data relevant to HGA's Digital Practice Group. For questions regarding this data please reach out to the DPG.
code_block_28 = CodeBlock { "Starting View"; }
sheet_byname = Custom[Sheet ByName](NameOrNumber=code_block_28)  # package Genius Loci; Collects sheets by name or number in the active or given document.

# group: Script Run Data for Starter
code_block_29 = CodeBlock { "Script Revit Version"; "Script Run Date"; }
version = Custom[Application.Version]()  # package Clockwork for Dynamo 2.x; Retrieves the name, version and build of the current Revit application.
string_from_object_5 = FromObject(obj=version.Build)
setParameterByName = Element.SetParameterByName(element=sheet_byname, parameterName=code_block_29.out0, value=string_from_object_5)
today = DateTime.Today()
string_from_object_6 = FromObject(obj=today)
code_block_30 = CodeBlock { " "; true; }
removeAfterCharacters = dtCore.String.RemoveAfterCharacters(str=string_from_object_6, characters=code_block_30.out0, includeChar=code_block_30.out1)
code_block_31 = CodeBlock { "/"; }
split = String.Split(string=removeAfterCharacters, separator0=code_block_31)
code_block_32 = CodeBlock { 2; 0; 1; }
getItemAtIndex = List.GetItemAtIndex(list=split, index=code_block_32.out0)
code_block_33 = CodeBlock { "."; }
getItemAtIndex_2 = List.GetItemAtIndex(list=split, index=code_block_32.out1)
getItemAtIndex_3 = List.GetItemAtIndex(list=split, index=code_block_32.out2)
concat = String.Concat(string0=getItemAtIndex, string1=code_block_33, string2=getItemAtIndex_2, string3=code_block_33, string4=getItemAtIndex_3)
setParameterByName_2 = Element.SetParameterByName(element=setParameterByName, parameterName=code_block_29.out1, value=concat)
code_block_34 = CodeBlock { "Save Here - HGA"; }
byFamilyNameAndTypeName = FamilyType.ByFamilyNameAndTypeName(familyName=code_block_34, typeName=code_block_34)
all_elements_of_family_type = ElementsOfFamilyType(Family_Type=byFamilyNameAndTypeName)
code_block_35 = CodeBlock { "Script Was Run Visibility"; }
setParameterByName_3 = Element.SetParameterByName(element=all_elements_of_family_type, parameterName=code_block_35, value=ui_multipleinputform.Was_Run)

code_block_36 = CodeBlock { "Confidential Project"; }
setParameterByName_4 = Element.SetParameterByName(element=all_elements_of_family_type, parameterName=code_block_36, value=code_block_17.out0)
containsThisOrThat_9 = dtCore.String.ContainsThisOrThat(str=string_from_object_4, searchFor=watch, ignoreCase=boolean_4)

# group (continued): Remove Levels and Associated Views
filterByBoolMask_10 = List.FilterByBoolMask(list=all_elements_of_type_10, mask=containsThisOrThat_9)

delete_2 = archilab.Revit.Elements.Elements.Delete(element=filterByBoolMask_10.in)

# group: Overall and 1/8" Floor Plans
categories = Categories("OST_Sheets")
all_elements_of_category = ElementsOfCategory(Category=categories)
sheetNumber = Sheet.SheetNumber(sheet=all_elements_of_category)
code_block_37 = CodeBlock { "ROADBLOCK"; ".X"; }
contains_2 = String.Contains(string=sheetNumber, searchFor=code_block_37.out1)
filterByBoolMask_11 = List.FilterByBoolMask(list=all_elements_of_category, mask=contains_2)
code_block_38 = CodeBlock { "Sheet Number"; }
sheetNumber_2 = Sheet.SheetNumber(sheet=filterByBoolMask_11.in)
length = String.Length(string=sheetNumber_2)
code_block_39 = CodeBlock { 2; }
sub = length - code_block_39
remove = String.Remove(string=sheetNumber_2, startIndex=sub, count=code_block_39)
code_block_40 = CodeBlock { ".Y"; "ROADBLOCK"; }
if_ = RefactoredIf(test=code_block_17.out2, true=code_block_40.out0, false=code_block_40.out1)
contains_3 = String.Contains(string=sheetNumber, searchFor=if_)
filterByBoolMask_12 = List.FilterByBoolMask(list=all_elements_of_category, mask=contains_3)
flatten_9 = List.Flatten(list=filterByBoolMask_12.in)
delete_3 = Element.Delete(element=flatten_9)
passthrough = Custom[Passthrough](passThrough=remove, waitFor=delete_3)  # package Clockwork for Dynamo 2.x; Forces a sequential order of execution. The node wired into the output of the Passthrough node will be executed *after* the node wired into the waitFor input (e.g. important for some Revit operations). The value of the passThrough input will be passed on to the node wired into the output port of the Passthrough node.
setParameterByName_5 = Element.SetParameterByName(element=filterByBoolMask_11.in, parameterName=code_block_38, value=passthrough)
contains_4 = String.Contains(string=sheetNumber, searchFor=code_block_40.out0)
filterByBoolMask_13 = List.FilterByBoolMask(list=all_elements_of_category, mask=contains_4)
sheetNumber_3 = Sheet.SheetNumber(sheet=filterByBoolMask_13.in)
length_2 = String.Length(string=sheetNumber_3)
code_block_41 = CodeBlock { 2; }
sub_2 = length_2 - code_block_41
remove_2 = String.Remove(string=sheetNumber_3, startIndex=sub_2, count=code_block_41)
if_2 = RefactoredIf(test=code_block_17.out2, true=code_block_37.out0, false=code_block_37.out1)
contains_5 = String.Contains(string=sheetNumber, searchFor=if_2)
filterByBoolMask_14 = List.FilterByBoolMask(list=all_elements_of_category, mask=contains_5)
views = Sheet.Views(sheet=filterByBoolMask_14.in)
type = Object.Type(object=views)
code_block_42 = CodeBlock { "Plan"; }
contains_6 = String.Contains(string=type, searchFor=code_block_42)
filterByBoolMask_15 = List.FilterByBoolMask(list=views, mask=contains_6)
flatten_10 = List.Flatten(list=filterByBoolMask_15.in)
list_create = List.Create(item0=filterByBoolMask_14.in, item1=flatten_10)
flatten_11 = List.Flatten(list=list_create)
delete_4 = Element.Delete(element=flatten_11)
passthrough_2 = Custom[Passthrough](passThrough=remove_2, waitFor=delete_4)
setParameterByName_6 = Element.SetParameterByName(element=filterByBoolMask_13.in, parameterName=code_block_38, value=passthrough_2)
